# Grasshopper definition TRAVE LANGER.gh (Grasshopper 0.9.76)
# plug-ins: Karamba, Human

L = Slider(17, range=0..17)
number_slider = Slider(0, range=0..100)
f = Slider(2, range=0..10)
division = Division(A=L, B="2")
construct_point = ConstructPoint(XCoordinate=number_slider, YCoordinate=number_slider, ZCoordinate=number_slider)
vector_xyz = VectorXYZ(XComponent=L, YComponent=number_slider, ZComponent=number_slider)  # -> Vector, Length

multiplication = Multiplication(A=L, B=Slider(1.02, range=1..1.1))
catenary = Catenary(PointA=construct_point, PointB=vector_xyz.Vector, Length=multiplication, Gravity=Vector(0, 0, -1))
xy_plane = XYPlane(Origin=Point(0, 0, 0))
mirror = Mirror(Geometry=catenary, Plane=xy_plane)  # -> Geometry, Transform

vector_xyz_2 = VectorXYZ(XComponent=division, YComponent=number_slider, ZComponent=f)  # -> Vector, Length
move = Move(Geometry=construct_point, Motion=vector_xyz.Vector)  # -> Geometry, Transform
move_2 = Move(Geometry=construct_point, Motion=vector_xyz_2.Vector)  # -> Geometry, Transform
line = Line(StartPoint=vector_xyz.Vector, EndPoint=construct_point)
entwine = Entwine(Branch00=construct_point, Branch01=move_2.Geometry, Branch02=move.Geometry, FlattenInputs=True)
vincolo_a = Point(construct_point)
# trave su più appoggi
vincolo_b = Point(move.Geometry)
entwine_2 = Entwine(Branch00=construct_point, Branch01=move.Geometry, FlattenInputs=True)
trave = Interpolate(Vertices=flatten(entwine_2), Degree=3, Periodic=False, KnotStyle=1)  # -> Curve, Length, Domain
arco = Interpolate(Vertices=flatten(entwine), Degree=Slider(2, range=0..10), Periodic=False, KnotStyle=1)  # -> Curve, Length, Domain
divide_curve = DivideCurve(Curve=trave.Curve, Count=Slider(7, range=0..100), Kinks=False)  # -> Points, Tangents, Parameters
curve = Curve(arco.Curve)
line_sdl = LineSDL(Start=divide_curve.Points, Direction=Vector(0, 0, 1), Length=Slider(3, range=0..10))
number_slider_2 = Slider(19, range=0..100)
trave_2 = Shatter(Curve=trave.Curve, Parameters=divide_curve.Parameters)
panel = Panel("""2
4
6""")
multiple_curves = MultipleCurves(Curves=flatten([arco.Curve, line_sdl]))  # -> Points, IndexA, IndexB, ParamA, ParamB
shatter = Shatter(Curve=curve, Parameters=multiple_curves.ParamA)
panel_2 = Panel("""1
3
5""")
divide_curve_2 = DivideCurve(Curve=shatter, Count=number_slider_2, Kinks=False)  # -> Points, Tangents, Parameters
divide_curve_3 = DivideCurve(Curve=trave_2, Count=number_slider_2, Kinks=False)  # -> Points, Tangents, Parameters
polyline = PolyLine(Vertices=divide_curve_2.Points, Closed=False)
material_properties_karamba3d = MaterialPropertiesKaramba3D(
    FamilyOfMaterial="Steel",
    Name="S235",
    YoungsModulus_kN_cm2=21000,
    InPlaneShearModulus_kN_cm2=8076,
    TransverseShearModulus_kN_cm2=8076,
    SpecificWeight_kN_m3=78.5,
    CoefficientOfThermalExpansion_1_C=1e-05,
    YieldStrength_kN_cm2=23.5,
    mode="Isotrop")
pennini = Line(StartPoint=multiple_curves.Points, EndPoint=divide_curve.Points)
polyline_2 = PolyLine(Vertices=divide_curve_3.Points, Closed=False)
rottura_pennini = CullIndex(List=pennini, Wrap=True)
arco_2 = Explode(Curve=polyline, Recursive=True)  # -> Segments, Vertices
material_selection_karamba3d = MaterialSelectionKaramba3D(Materials=material_properties_karamba3d, menu=[dropdown(0), dropdown(0)])  # disabled
cross_section_karamba3d = CrossSectionKaramba3D(
    FamilyNameOfCrossSection="DefaultCroSec",
    NameOfCrossSection="ARCO",
    Material=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,
    Diameter_cm="19.37",
    WallThickness_cm="1.6",
    mode="Circular Hollow")
cross_section_selector_karamba3d = CrossSectionSelectorKaramba3D(NameOrListIndexOfCrossSection="IPE500")  # -> CrossSection, Info
colour_swatch = ColourSwatch(SwatchColor=RGB(149, 255, 0))
line_to_beam_karamba3d = LineToBeamKaramba(
    Line=arco_2.Segments,
    Color=ColourSwatch(SwatchColor=RGBA(247, 7, 211, 240)),
    Identifier="ARCO",
    CrossSection=cross_section_karamba3d,
    New=True,
    Remove=True,
    LimitDistance_m=0.005)  # -> Element, Points, Info
cross_section_karamba3d_2 = CrossSectionKaramba3D(
    FamilyNameOfCrossSection="DefaultCroSec",
    ElementIdentifier="PENNINI",
    Color=colour_swatch,
    Material=material_selection_karamba3d,
    Diameter_cm="8.89",
    WallThickness_cm=Slider(0.6, range=0..1),
    mode="Circular Hollow")
line_to_beam_karamba3d_2 = LineToBeamKaramba(
    Line=polyline_2,
    Color=ColourSwatch(SwatchColor=RGBA(13, 115, 211, 240)),
    Identifier="TRAVE",
    CrossSection=cross_section_selector_karamba3d.CrossSection,
    New=True,
    Remove=True,
    LimitDistance_m=0.005)  # -> Element, Points, Info
line_to_beam_karamba3d_3 = LineToBeamKaramba(
    Line=pennini,
    Color=colour_swatch,
    Identifier="PENNINI",
    CrossSection=cross_section_karamba3d_2,
    New=True,
    Remove=True,
    LimitDistance_m=0.005,
    Bending=Toggle(False))  # -> Element, Points, Info
beam_joints_karamba3d = BeamJointsKaramba3D(
    ElementIdentifiers="PENNINI",
    CtKNMAtStartingNode=Vector(0, 0, 0),
    CrKNmRadAtStartingNode=Vector(0, 0, 0),
    CtKNMAtEndNode=Vector(0, 0, 0),
    CrKNmRadAtEndNode=Vector(0, 0, 0),
    menu=[buttons(off, on, off, off, off, off), buttons(off, on, off, off, off, off)])
entwine_3 = Entwine(Branch01=beam_joints_karamba3d, FlattenInputs=True)
entwine_4 = Entwine(
    Branch00=line_to_beam_karamba3d.Element,
    Branch01=line_to_beam_karamba3d_2.Element,
    Branch02=line_to_beam_karamba3d_3.Element,
    FlattenInputs=True)
fslu = Panel("64.10")
fsle = Panel("48.28")
negative = Negative(Value=fsle)
number_slider_3 = Slider(0, range=0..100)
unit_z = UnitZ(Factor=negative)
point = Point(divide_curve.Points)  # disabled
support_karamba3d = SupportKaramba(PosInd=vincolo_b, menu=[buttons(off, on, on, on, off, on)])  # -> flatten(Support)
support_karamba3d_2 = SupportKaramba(PosInd=[vincolo_a, point], menu=[buttons(on, on, on, on, off, on)])  # -> flatten(Support)
loads_karamba3d = LoadsKaramba(Vector=unit_z, BeamIdentifiers="TRAVE", LCase=number_slider_3, mode="Uniform Line", menu=[buttons(off, off, on)])
loads_karamba3d_2 = LoadsKaramba(Vector=Vector(0, 0, -1), LCase="0", mode="Gravity")
entwine_5 = Entwine(Branch00=loads_karamba3d, Branch01=loads_karamba3d_2, FlattenInputs=True)
entwine_6 = Entwine(Branch00=support_karamba3d_2, Branch01=support_karamba3d, FlattenInputs=True)
assemble_model_karamba3d = AssembleModelKaramba(Elem=flatten(entwine_4), Support=flatten(entwine_6), Load=flatten(entwine_5), Joint=entwine_3, LimitDistance_m=0.005)  # -> Model, Info, Mass_kg, CenterOfGravity
analyzethi_karamba3d = AnalyzeThIKaramba(Model=assemble_model_karamba3d.Model)  # -> CalculatedModel, flatten(MaximumDisplacement_m), ResultingForceOfGravity_kN, ElasticEnergy_kNm
analyzethii_karamba3d = AnalyzeThIIKaramba3D(Model=assemble_model_karamba3d.Model, LoadCase="0", RTolerance=1e-07, MaxIterations=50, NoTensionalNII=False)  # -> CalculatedModel, MaximumDisplacement_cm, ResultingForceOfGravity_kN, ElasticEnergy_kNm
list_item = ListItem(List=analyzethi_karamba3d.MaximumDisplacement_m, Index=0, Wrap=True)
colours = LegendColour()
model_view_karamba3d = ModelViewKaramba(
    Model=analyzethi_karamba3d.CalculatedModel,
    LoadCaseFactorsForLinearSuperposition=1,
    IndexOfVisibleLoadcase=-1,
    ListOfColorsForColoringPlots=colours)  # -> Model, DeformedMesh, DeformedAxes, DeformedModel
division_2 = Division(A=L, B=Slider(500, range=0..1000))
beam_view_karamba3d = BeamViewKaramba(Model=model_view_karamba3d.Model)  # -> Model, MeshesOfRenderedBeams, DeformedBeamAxes, LegendColors, LegendTags
reaction_forces_karamba3d = ReactionForcesKaramba3D(AnalyzedModel=beam_view_karamba3d.Model, LoadCase=number_slider_3)  # -> AnalyzedModel, ReactionForces_kN, ReactionMoments_kNm, SupportPosition, SumOfReactionForces_kN, SumOfReactionMoments_kNm
f_sle_rara = Panel(list_item)
fmax = Panel(division_2)
buckling_modes_karamba3d = BucklingModesKaramba3D(
    Model=analyzethii_karamba3d.CalculatedModel,
    FromIndex=1,
    NumberOfModes=Slider(5, range=0..10),
    MaximumNumberOfIterations=300,
    Epsilon=1e-07)  # -> ModelWithBucklingModesAsLoadCaseResults, BucklingLoadFactors
natural_vibrations_karamba3d = NaturalVibrationsKaramba3D(
    Model=buckling_modes_karamba3d.ModelWithBucklingModesAsLoadCaseResults,
    FromIndex=1,
    NumberOfModes=Slider(4, range=0..100),
    MaximumNumberOfIterations=30,
    Epsilon=1e-05)  # -> ModelWithVibrationModesAsLoadCaseResults, NaturalFrequencies_Hz, ModalMass_kg, ParticipationFactorInGlobalXYAndZDirection
frequenza = Panel(natural_vibrations_karamba3d.NaturalFrequencies_Hz)
massa_partecipante = Panel(natural_vibrations_karamba3d.ModalMass_kg)
beam_forces_karamba3d = BeamForcesKaramba(
    AnalyzedModel=beam_view_karamba3d.Model,
    BeamIdentifiers="TRAVE",
    LCase=-1,
    MaximumDistanceBetweenResults_m=-1,
    NumberOfResultsPerBeamElement="1")  # -> AnalyzedModel, NormalForce_kN, ShearForceVz_kN, ShearForceVy_kN, BendingMomentMt_kNm, BendingMomentMy_kNm, BendingMomentMz_kNm
division_3 = Division(A="1", B=frequenza)
nodal_displacements_karamba3d = NodalDisplacementsKaramba3D(AnalyzedModel=beam_view_karamba3d.Model, LoadCase=0)  # -> AnalyzedModel, NodalTranslations_m, NodalRotations_rad
periodo = Panel(division_3)
multiplication_2 = Multiplication(A=f_sle_rara, B=Slider(1000, range=0..1000))
multiplication_3 = Multiplication(A=fmax, B=Slider(1000, range=0..1000))
N = Panel(beam_forces_karamba3d.NormalForce_kN)
explode_tree = ExplodeTree(Data=buckling_modes_karamba3d.BucklingLoadFactors)  # -> Branch0, Branch1, Branch2
model_view_karamba3d_2 = ModelViewKaramba(
    Model=natural_vibrations_karamba3d.ModelWithVibrationModesAsLoadCaseResults,
    LoadCaseFactorsForLinearSuperposition=1,
    IndexOfVisibleLoadcase=-1,
    ListOfColorsForColoringPlots=colours)  # -> Model, DeformedMesh, DeformedAxes, DeformedModel
vx_vy_w = Panel(nodal_displacements_karamba3d.NodalTranslations_m)
number_slider_4 = Slider(1000, range=0..1000)
explode_tree_2 = ExplodeTree(Data=vx_vy_w)  # -> Branch0, Branch1, Branch2
V = Panel(beam_forces_karamba3d.ShearForceVz_kN)
beam_view_karamba3d_2 = BeamViewKaramba(Model=model_view_karamba3d_2.Model)  # -> Model, MeshesOfRenderedBeams, DeformedBeamAxes, LegendColors, LegendTags
reaction_forces_karamba3d_2 = ReactionForcesKaramba3D(AnalyzedModel=beam_view_karamba3d.Model, LoadCase=0)  # -> AnalyzedModel, ReactionForces_kN, ReactionMoments_kNm, SupportPosition, SumOfReactionForces_kN, SumOfReactionMoments_kNm
M = Panel(beam_forces_karamba3d.BendingMomentMy_kNm)
number_slider_5 = Slider(0, range=0..20)
model_view_karamba3d_3 = ModelViewKaramba(
    Model=buckling_modes_karamba3d.ModelWithBucklingModesAsLoadCaseResults,
    LoadCaseFactorsForLinearSuperposition=number_slider_5,
    IndexOfVisibleLoadcase=-1,
    ListOfColorsForColoringPlots=colours)  # -> Model, DeformedMesh, DeformedAxes, DeformedModel
subtraction = Subtraction(A=number_slider_5, B="1")
list_item_2 = ListItem(List=explode_tree.Branch0, Index=subtraction, Wrap=True)
beam_view_karamba3d_3 = BeamViewKaramba(Model=model_view_karamba3d_3.Model)  # -> Model, MeshesOfRenderedBeams, DeformedBeamAxes, LegendColors, LegendTags
list_item_3 = ListItem(List=flatten(assemble_model_karamba3d.Mass_kg), Index=0, Wrap=True)
number = Number(expr("Round(x,2)", multiplication_3))
number_2 = Number(expr("Round(x,2)", multiplication_2))
number_3 = Number(expr("Round(x,2)", list_item_3))
header = Panel("Bucking- load -factors:")

# ---- group: Performance parameters
entwine_7 = Entwine(Branch00=number_2, Branch01=number, Branch02=number_3, FlattenInputs=True)  # -> flatten(Result)
units = Panel("""  [mm]
  [mm]
  [Kg]""")
header_2 = Panel("""displacement max:
  L/500:  
Mass:""")
concatenate = Concatenate(FragmentA=header_2, FragmentB=entwine_7)
text = Text(concatenate)
panel_3 = Panel(text)
list_length = ListLength(List=text)
series = Series(Start=Slider(80, range=0..100), Step=Slider(23, range=0..100), Count=list_length)
construct_point_2 = ConstructPoint(XCoordinate=Slider(130, range=0..1000), YCoordinate=series, ZCoordinate=0)
render_text_to_screen = RenderTextToScreen(
    Text=text,
    Location=construct_point_2,
    Size=Slider(9, range=0..100),
    Color=ColourSwatch(SwatchColor=RGBA(0, 0, 0, 240)),
    m_scWithvp=False)

# ==== cluster LegendColour: Legend colour for Karamba
merge = Merge(
    Data1=ColourSwatch(SwatchColor=RGB(255, 0, 0)),
    Data2=ColourSwatch(SwatchColor=RGB(255, 179, 0)),
    Data3=ColourSwatch(SwatchColor=RGB(255, 255, 0)),
    Data4=ColourSwatch(SwatchColor=RGB(0, 255, 0)),
    Data5=ColourSwatch(SwatchColor=RGB(0, 255, 255)),
    Data6=ColourSwatch(SwatchColor=RGB(4, 177, 255)),
    Data7=ColourSwatch(SwatchColor=RGB(0, 0, 255)),
    Data8=ColourSwatch(SwatchColor=RGB(129, 0, 190)),
    Data9=ColourSwatch(SwatchColor=RGB(75, 0, 130)))  # -> reverse(Result)
legend = ClusterOutput(merge)  # List of colours to plug on Karamba Legend
