# Grasshopper definition progetto TDCII.gh (Grasshopper 0.9.76)
# plug-ins: Karamba, Konstru, Weaverbird, Kangaroo2 Components

pt = ConstructPoint(XCoordinate=0, YCoordinate=0, ZCoordinate=0)
lunghezza_trave_principale = Panel("8.5")
X = UnitX(Factor=lunghezza_trave_principale)
move = Move(Geometry=pt, Motion=X)  # -> Geometry, Transform
ln = Line(StartPoint=pt, EndPoint=move.Geometry)
len = Length(Curve=ln)
passo_travi_secondarie = Division(A=lunghezza_trave_principale, B="4")
division = Division(A=len, B=passo_travi_secondarie)
numero_di_telai_nella_direzione_y = Slider(5, range=0..10)
interasse_y_telai = Slider(7.5, range=4..8)
divide = DivideCurve(Curve=ln, Count=division, Kinks=False)  # -> Points, Tangents, Parameters
pline = PolyLine(Vertices=divide.Points, Closed=False)
multiplication = Multiplication(A=numero_di_telai_nella_direzione_y, B=interasse_y_telai)
dom = ConstructDomain(DomainStart=0, DomainEnd=multiplication)
division_2 = Division(A=multiplication, B=interasse_y_telai)
addition = Addition(A=lunghezza_trave_principale, B="17")
range = Range(Domain=dom, Steps=division_2)
X_2 = UnitX(Factor=addition)
Y = UnitY(Factor=range)
move_2 = Move(Geometry=pline, Motion=Y)  # -> Geometry, Transform
explode = Explode(Curve=move_2.Geometry, Recursive=True)  # -> Segments, simplify(Vertices)
flip = FlipMatrix(Data=explode.Vertices)  # -> simplify(Data)
pline_2 = PolyLine(Vertices=flip, Closed=False)
explode_2 = Explode(Curve=pline_2, Recursive=True)  # -> Segments, Vertices
orditura_x = Curve(simplify(explode.Segments))
orditura_y = Curve(simplify(explode_2.Segments))
dom_2 = ConstructDomain(DomainStart=Slider(20, range=0..100), DomainEnd=Slider(24, range=0..24))
interasse_piano = Slider(4, range=3..5)
n_di_piani = Slider(4, range=3..30)
dom_3 = ConstructDomain(DomainStart=Slider(0, range=0..100), DomainEnd=Slider(4, range=0..24))
wbweave = WeaverbirdsMeshFromLinesWeaveBack(Lines=flatten([orditura_x, orditura_y]), MaximumValence=4)
series = Series(Start=0, Step=interasse_piano, Count=n_di_piani)
Z = UnitZ(Factor=series)
division_3 = Division(A="17", B="2")
move_3 = Move(Geometry=wbweave, Motion=Z)  # -> Geometry, Transform
move_4 = Move(Geometry=move_3.Geometry, Motion=X_2)  # -> Geometry, Transform
warpweft = WarpWeft(Mesh=move_4.Geometry)  # -> Warp, Weft, NakedA, NakedB
demesh = DeconstructMesh(Mesh=move_4.Geometry)  # -> Vertices, Faces, Colours, Normals
travi_principali = Curve(simplify(warpweft.Weft))
flip_2 = FlipMatrix(Data=demesh.Vertices)
travi_secondarie = Curve(simplify(warpweft.Warp))
pline_3 = PolyLine(Vertices=flip_2, Closed=False)  # -> simplify(Polyline)
colonne = Curve(pline_3)
vec = VectorXYZ(XComponent=division_3, YComponent=0, ZComponent=Slider(2, range=0..10))  # -> Vector, Length
panel = Panel("""6
7
8
9
10
11
12
13
14
15
16
17
18
19
20
21
22
23""")
path = ConstructPath(Indices=Slider(0, range=0..100))
demesh_2 = DeconstructMesh(Mesh=move_3.Geometry)  # -> Vertices, Faces, Colours, Normals
flip_3 = FlipMatrix(Data=colonne)
warpweft_2 = WarpWeft(Mesh=move_3.Geometry)  # -> Warp, Weft, NakedA, NakedB
path_2 = ConstructPath(Indices=Slider(0, range=0..100))
flip_4 = FlipMatrix(Data=demesh_2.Vertices)
pline_4 = PolyLine(Vertices=flip_4, Closed=False)  # -> simplify(Polyline)
cull_i = CullIndex(List=flip_3, Indices=panel, Wrap=True)
split = SplitTree(Data=travi_principali, Masks=flatten(path))  # -> Positive, Negative
split_2 = SplitTree(Data=travi_secondarie, Masks=flatten(path_2))  # -> Positive, Negative
colonne_2 = Curve(pline_4)
end = EndPoints(Curve=cull_i)  # -> Start, End
path_3 = ConstructPath(Indices=Slider(3, range=0..100))
path_4 = ConstructPath(Indices=Slider(3, range=0..100))
panel_2 = Panel("""6
7
8
9
10
11
12
13
14
15
16
17
18
19
20
21
22
23""")
flip_5 = FlipMatrix(Data=colonne_2)
travi_principali_2 = Curve(simplify(warpweft_2.Warp))
travi_secondarie_2 = Curve(simplify(warpweft_2.Weft))
split_3 = SplitTree(Data=split.Negative, Masks=flatten(path_3))  # -> Positive, Negative
explode_3 = Explode(Curve=cull_i, Recursive=True)  # -> simplify(Segments), Vertices
split_4 = SplitTree(Data=split_2.Negative, Masks=flatten(path_4))  # -> Positive, Negative
end_2 = EndPoints(Curve=travi_secondarie_2)  # -> Start, End
t_princ_copertura = Curve(split_3.Positive)
cull_i_2 = CullIndex(List=flip_5, Indices=panel_2, Wrap=True)

item = ListItem(List=cull_i_2, Index=0, Wrap=True)  # -> Item, Item1, Item2, Item3, Item4, Item5, Item6, Item7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
item_2 = ListItem(List=cull_i, Index=0, Wrap=True)  # -> Item, Item1, Item2, Item3, Item4, Item5, Item6, Item7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
crv = Curve([item.Item2, item.Item3, item.Item8, item.Item9])
crv_2 = Curve([item_2.Item2, item_2.Item3, item_2.Item8, item_2.Item9])
graft = GraftTree(Tree=[crv, crv_2], IncludeEmptyLists=True, IncludeNullItems=True)
divide_2 = DivideCurve(Curve=graft, Count=Slider(3, range=0..10), Kinks=False)  # -> Points, Tangents, Parameters
bang = ExplodeTree(Data=simplify(divide_2.Points))  # -> Branch0, Branch1, Branch2, Branch3, Branch4, Branch5, Branch6, Branch7
entwine = Entwine(Branch00=bang.Branch0, Branch01=bang.Branch2, Branch02=bang.Branch4, Branch03=bang.Branch6, FlattenInputs=True)
entwine_2 = Entwine(Branch00=bang.Branch1, Branch01=bang.Branch3, Branch02=bang.Branch5, Branch03=bang.Branch7, FlattenInputs=True)
shift = ShiftList(List=entwine, Shift=1, Wrap=invert(True))
shift_2 = ShiftList(List=entwine_2, Shift=1, Wrap=invert(True))
ln_2 = Line(StartPoint=entwine_2, EndPoint=shift)
ln_3 = Line(StartPoint=entwine, EndPoint=shift_2)
cull_i_3 = CullIndex(List=ln_2, Indices=Slider(3, range=0..10), Wrap=True)
cull_i_4 = CullIndex(List=ln_3, Indices=Slider(3, range=0..10), Wrap=True)
crv_3 = Curve([cull_i_3, cull_i_4])

rdlines = RemoveDuplicateLinesKaramba3D(Line=crv_3, LimitDistance=0.005)  # -> OutLine, Info, Indexes
t_principale = Curve(split_3.Negative)
end_3 = EndPoints(Curve=cull_i_2)  # -> Start, End
crv_4 = Curve(explode_3.Segments)
path_5 = ConstructPath(Indices=Slider(0, range=0..100))
path_6 = ConstructPath(Indices=Slider(0, range=0..100))
t_sec_copertura = Curve(split_4.Positive)
subset = SubList(List=t_sec_copertura, Domain=dom_3, Wrap=True)  # -> List, Index
crv_5 = Curve(subset.List)
explode_4 = Explode(Curve=crv_5, Recursive=True)  # -> Segments, flatten(Vertices)
rdpoints = RemoveDuplicatePointsKaramba3D(Point=explode_4.Vertices, LimitDistance=0.005)  # -> OutPoint, Info, Indexes
t_secondaria = Curve(split_4.Negative)
path_7 = ConstructPath(Indices=Slider(3, range=0..100))
path_8 = ConstructPath(Indices=Slider(3, range=0..100))
explode_5 = Explode(Curve=cull_i_2, Recursive=True)  # -> simplify(Segments), Vertices
split_5 = SplitTree(Data=travi_principali_2, Masks=flatten(path_6))  # -> Positive, Negative
split_6 = SplitTree(Data=travi_secondarie_2, Masks=flatten(path_5))  # -> Positive, Negative
split_7 = SplitTree(Data=split_6.Negative, Masks=flatten(path_7))  # -> Positive, Negative
split_8 = SplitTree(Data=split_5.Negative, Masks=flatten(path_8))  # -> Positive, Negative
crv_6 = Curve(explode_5.Segments)
number_slider = Slider(1, range=0..10)
t_princ_copertura_2 = Curve(split_7.Positive)
t_sec_copertura_2 = Curve(split_8.Positive)
subset_2 = SubList(List=t_sec_copertura_2, Domain=dom_2, Wrap=True)  # -> List, Index
crv_7 = Curve(subset_2.List)
explode_6 = Explode(Curve=crv_7, Recursive=True)  # -> Segments, flatten(Vertices)
rdpoints_2 = RemoveDuplicatePointsKaramba3D(Point=explode_6.Vertices, LimitDistance=0.005)  # -> OutPoint, Info, Indexes
move_5 = Move(Geometry=rdpoints_2.OutPoint, Motion=vec.Vector)  # -> Geometry, Transform
entwine_3 = Entwine(Branch00=rdpoints_2.OutPoint, Branch01=move_5.Geometry, Branch02=rdpoints.OutPoint, FlattenInputs=True)
flip_6 = FlipMatrix(Data=entwine_3)
ln_4 = Line(StartPoint=rdpoints_2.OutPoint, EndPoint=rdpoints.OutPoint)
intcrv = Interpolate(Vertices=flip_6, Degree=Slider(2, range=0..10), Periodic=False, KnotStyle=1)  # -> Curve, Length, Domain
number_slider_2 = Slider(8, range=0..100)
number_slider_3 = Slider(1, range=0..10)
subtraction = Subtraction(A=number_slider_2, B=number_slider_3)
divide_3 = DivideCurve(Curve=ln_4, Count=number_slider_2, Kinks=False)  # -> Points, Tangents, Parameters
dom_4 = ConstructDomain(DomainStart=number_slider_3, DomainEnd=subtraction)
subset_3 = SubList(List=divide_3.Points, Domain=dom_4, Wrap=True)  # -> List, Index
line = LineSDL(Start=subset_3.List, Direction=Vector(0, 0, 1), Length=Slider(3, range=0..10))
number_slider_4 = Slider(0, range=0..100)
trave = Shatter(Curve=ln_4, Parameters=divide_3.Parameters)
divide_4 = DivideCurve(Curve=intcrv.Curve, Count=number_slider_2, Kinks=False)  # -> Points, Tangents, Parameters
clx = CurveLine(Curve=graft(intcrv.Curve), Line=line)  # -> flatten(Points), flatten(Params), Count
pt_2 = Point(flatten(subset_3.List))
# MARCO GUARDA QUI
subset_4 = SubList(List=divide_4.Points, Domain=dom_4, Wrap=True)  # -> List, Index
flip_7 = FlipMatrix(Data=subset_3.List)
t_secondarie_1 = Curve([split_8.Negative, t_secondaria])
t_primarie_2 = Curve([split_7.Negative, t_principale])
entwine_4 = Entwine(Branch00=t_princ_copertura_2, Branch01=t_princ_copertura, FlattenInputs=True)
entwine_5 = Entwine(Branch00=t_sec_copertura_2, Branch01=t_sec_copertura, FlattenInputs=True)
colonne_3 = Curve([crv_6, crv_4])

X_3 = UnitX(Factor=1)
crv_cp = CurveClosestPoint(Point=subset_4.List, Curve=intcrv.Curve)  # -> Point, Parameter, Distance
line_2 = LineSDL(Start=crv_cp.Point, Direction=X_3, Length=1)
pframe = PerpFrame(Curve=intcrv.Curve, Parameter=crv_cp.Parameter)
pi = Pi(Factor=Slider(0.5, range=0..1))
vb_rotate_plane = VBRotatePlane(P=pframe, A=pi, X="y", TooltipTextOverride="Rotate Plane")  # -> out, F; inputs P: Plane
# ---------- vb_rotate_plane: VB ----------
    '/// Pieter Segeren okt 04 2014

    Component.Params.Input(0).Name = "Plane"
    Component.Params.Input(0).Description = "Plane to rotate"
    Component.Params.Input(1).Name = "Angle"
    Component.Params.Input(1).Description = "Rotation angle in radians"
    Component.Params.Input(2).Name = "Axis"
    Component.Params.Input(2).Description = "Local axis for rotation (As text)"
    '/// Note: the standard "out" output is Output(0), IF "out" is shown... mind that if you reinstate the "out"
    Component.Params.Output(1).Name = "Plane"
    Component.Params.Output(1).Description = "Rotated Plane"

    Dim ax As Vector3d = New Vector3d

    Select Case X.ToUpper
      Case "X"
        ax = P.XAxis
      Case "Y"
        ax = P.YAxis
      Case "Z"
        ax = P.ZAxis
    End Select

    Dim resPlane As Plane = New Plane
    If P.Rotate(A, ax) Then
      resPlane = P
    End If

    F = resPlane
# ---------- end vb_rotate_plane ----------
angle = Angle(VectorA=vb_rotate_plane.F, VectorB=line_2)  # -> Angle, Reflex

pennini = Line(StartPoint=pt_2, EndPoint=clx.Points)
pt_3 = Point(subset_4.List)
pline_5 = PolyLine(Vertices=flip_7, Closed=False)
flip_8 = FlipMatrix(Data=pt_3)
explode_7 = Explode(Curve=pline_5, Recursive=True)  # -> Segments, Vertices
pline_6 = PolyLine(Vertices=flip_8, Closed=False)
explode_8 = Explode(Curve=pline_6, Recursive=True)  # -> Segments, Vertices
deg = Degrees(Radians=angle.Angle)
profile_by_name = ProfileByName(ProfileName="IPE220", Catalog=1)
material = Material(Name="S235", Type=0)
beam = Beam(
    Profile=profile_by_name,
    Curve=explode_8.Segments,
    Name="T.S.Copertura2",
    Rotation_Degrees=deg,
    ZOffset=0,
    YOffset=0,
    StartExtension=0,
    EndExtension=0,
    JustificationZ=1,
    JustificationY=1,
    Material=material)  # -> flatten(Element), flatten(Geometry)
createcircularprofile = CreateCircularProfile(Diameter=Slider(0.2, range=0..1), Catalog=1, DiameterHole=Slider(0.01, range=0..0.01))
profile_by_name_2 = ProfileByName(ProfileName="HE260A", Catalog=1)
profile_by_name_3 = ProfileByName(ProfileName="UPN220", Catalog=1)
material_2 = Material(Name="S235", Type=9)
profile_by_name_4 = ProfileByName(ProfileName="HE360B", Catalog=1)
createcircularprofile_2 = CreateCircularProfile(Diameter=Slider(0.3556, range=0..1), Catalog=1, DiameterHole=Slider(0.025, range=0..0.1))
beam_2 = Beam(
    Profile=createcircularprofile,
    Curve=intcrv.Curve,
    Name="Arco",
    ZOffset=0,
    YOffset=0,
    StartExtension=0,
    EndExtension=0,
    JustificationZ=1,
    JustificationY=1,
    Material=material_2)  # -> flatten(Element), flatten(Geometry)
profile_by_name_5 = ProfileByName(ProfileName="HE320A", Catalog=1)
cable = Cable(Curve=pennini, Diameter=Slider(0.012, range=0..0.1), Name="Cavi")  # -> flatten(Element), graft(Geometry); disabled
beam_3 = Beam(
    Profile=profile_by_name_2,
    Curve=trave,
    Name="T.P.Copertura2",
    ZOffset=0,
    YOffset=0,
    StartExtension=0,
    EndExtension=0,
    JustificationZ=1,
    JustificationY=1,
    Material=material)  # -> flatten(Element), flatten(Geometry); disabled
profile_by_name_6 = ProfileByName(ProfileName="HE260A", Catalog=1)
profile_by_name_7 = ProfileByName(ProfileName="IPE220", Catalog=1)
profile_by_name_8 = ProfileByName(ProfileName="HE260A", Catalog=1)
beam_4 = Beam(
    Profile=profile_by_name_3,
    Curve=rdlines.OutLine,
    Name="Controventi",
    ZOffset=0,
    YOffset=0,
    StartExtension=0,
    EndExtension=0,
    JustificationZ=1,
    JustificationY=1,
    Material=material)  # -> flatten(Element), flatten(Geometry)
column = Column(Profile=createcircularprofile_2, Curve=colonne_3, Name="Colonne1", Material=material)  # -> flatten(Element), flatten(Geometry)
beam_5 = Beam(
    Profile=profile_by_name_5,
    Curve=t_primarie_2,
    Name="T.P.telaio",
    ZOffset=0,
    YOffset=0,
    StartExtension=0,
    EndExtension=0,
    JustificationZ=1,
    JustificationY=1,
    Material=material)  # -> flatten(Element), flatten(Geometry)
beam_6 = Beam(
    Profile=profile_by_name_6,
    Curve=t_secondarie_1,
    Name="T.S.telaio",
    ZOffset=0,
    YOffset=0,
    StartExtension=0,
    EndExtension=0,
    JustificationZ=1,
    JustificationY=1,
    Material=material)  # -> flatten(Element), flatten(Geometry)
beam_7 = Beam(
    Profile=profile_by_name_7,
    Curve=entwine_5,
    Name="T.S.Copertura1",
    ZOffset=0,
    YOffset=0,
    StartExtension=0,
    EndExtension=0,
    JustificationZ=1,
    JustificationY=1,
    Material=material)  # -> flatten(Element), flatten(Geometry)
beam_8 = Beam(
    Profile=profile_by_name_8,
    Curve=entwine_4,
    Name="T.P.Copertura1",
    ZOffset=0,
    YOffset=0,
    StartExtension=0,
    EndExtension=0,
    JustificationZ=1,
    JustificationY=1,
    Material=material)  # -> flatten(Element), flatten(Geometry)
entwine_6 = Entwine(
    Branch00=beam_8.Element,
    Branch01=beam_7.Element,
    Branch02=beam_6.Element,
    Branch03=beam_5.Element,
    Branch04=beam_2.Element,
    Branch05=beam_3.Element,
    Branch06=beam.Element,
    FlattenInputs=True)
column_2 = Column(Element=column.Element)  # -> Element, Profile, Curve, Name, Rotation_Degrees, TopOffset, BottomOffset, Material, Attributes, Geometry
cable_2 = Cable(Element=cable.Element)  # -> Element, Curve, Diameter, Name, Material, Attributes, Geometry; disabled
beam_9 = Beam(Element=entwine_6)  # -> Element, Profile, Curve, Name, Rotation_Degrees, ZOffset, YOffset, StartExtension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
number_slider_5 = Slider(8, range=0..10)
addition_2 = Addition(A=number_slider_5, B="37.5")
addition_3 = Addition(A=number_slider_5, B="34")
neg = Negative(Value=number_slider_5)
addition_4 = Addition(A=number_slider_5, B=addition_2)
X_4 = UnitX(Factor=1)
vec_2 = VectorXYZ(XComponent=neg, YComponent=0, ZComponent=0)  # -> Vector, Length
number_slider_6 = Slider(8.5, range=0..10)
series_2 = Series(Start=Slider(0, range=0..100), Step=Slider(7.5, range=0..10), Count=Slider(6, range=0..10))
addition_5 = Addition(A=number_slider_5, B=addition_3)
Y_2 = UnitY(Factor=1)
vec_3 = VectorXYZ(XComponent=0, YComponent=neg, ZComponent=0)  # -> Vector, Length
line_3 = LineSDL(Start=vec_2.Vector, Direction=X_4, Length=addition_5)
Y_3 = UnitY(Factor=series_2)
line_4 = LineSDL(Start=vec_3.Vector, Direction=Y_2, Length=addition_4)
addition_6 = Addition(A=number_slider_6, B="17")
move_6 = Move(Geometry=line_3, Motion=Y_3)  # -> Geometry, Transform
X_5 = UnitX(Factor=number_slider_6)
X_6 = UnitX(Factor=addition_6)
move_7 = Move(Geometry=line_4, Motion=X_5)  # -> Geometry, Transform
select_model = SelectModel(setid="5cb0ea913764d9000458e58c")
move_8 = Move(Geometry=[move_7.Geometry, line_4], Motion=X_6)  # -> Geometry, Transform
entwine_7 = Entwine(Branch00=move_6.Geometry, Branch01=move_8.Geometry, Branch02=line_4, Branch03=move_7.Geometry, FlattenInputs=True)
graft_2 = GraftTree(Tree=entwine_7, IncludeEmptyLists=True, IncludeNullItems=True)
bang_2 = ExplodeTree(Data=graft_2)  # -> Branch0, Branch1, Branch2, Branch3, Branch4, Branch5, Branch6, Branch7, Branch8, Branch9
number_slider_7 = Slider(0, range=0..100)
number_slider_8 = Slider(4, range=0..100)
number_slider_9 = Slider(8, range=0..100)
number_slider_10 = Slider(12, range=0..100)
panel_3 = Panel(number_slider_7)
panel_4 = Panel(number_slider_8)
panel_5 = Panel(number_slider_9)
panel_6 = Panel(number_slider_10)
grid = Grid(Curve=bang_2.Branch1, Name=flatten("B"))
grid_2 = Grid(Curve=bang_2.Branch0, Name=flatten("A"))
grid_3 = Grid(Curve=bang_2.Branch2, Name=flatten("c"))
grid_4 = Grid(Curve=bang_2.Branch3, Name=flatten("D"))
grid_5 = Grid(Curve=bang_2.Branch4, Name=flatten("E"))
grid_6 = Grid(Curve=bang_2.Branch5, Name=flatten("F"))
grid_7 = Grid(Curve=bang_2.Branch9, Name=flatten("2"))
grid_8 = Grid(Curve=bang_2.Branch6, Name=flatten("4"))
grid_9 = Grid(Curve=bang_2.Branch8, Name=flatten("1"))
grid_10 = Grid(Curve=bang_2.Branch7, Name=flatten("3"))
level = Level(Height=number_slider_7, Name=panel_3)
level_2 = Level(Height=number_slider_8, Name=panel_4)
level_3 = Level(Height=number_slider_9, Name=panel_5)
level_4 = Level(Height=number_slider_10, Name=panel_6)
entwine_8 = Entwine(
    Branch00=grid_2,
    Branch01=grid,
    Branch02=grid_3,
    Branch03=grid_4,
    Branch04=grid_5,
    Branch05=grid_6,
    Branch06=grid_8,
    Branch07=grid_10,
    Branch08=grid_7,
    Branch09=grid_9,
    FlattenInputs=True)
entwine_9 = Entwine(Branch00=level, Branch01=level_2, Branch02=level_3, Branch03=level_4, FlattenInputs=True)
grid_11 = Grid(Element=entwine_8)  # -> Element, Attributes, Curve, Name
entwine_10 = Entwine(
    Branch00=column_2.Element,
    Branch01=beam_9.Element,
    Branch02=cable_2.Element,
    Branch03=grid_11.Element,
    Branch04=entwine_9,
    Branch05=beam_4.Element,
    FlattenInputs=True)
elementids = ElementIDs(Element=entwine_10)  # -> KonstruID, RevitID, SAPID, ETABSID, RAMID, TeklaID, GrasshopperID, RhinoID, DynamoID
uploadkonstru = UploadKonstru(ModelID=select_model, Upload=Button(), Message="Tecnica2", AddOrUpdateElements=flatten(entwine_10))
