# Grasshopper definition progetto TDCII_RevMP.gh (Grasshopper 0.9.76)
# plug-ins: Karamba, Konstru, Weaverbird, Kangaroo2 Components

construct_point = ConstructPoint(XCoordinate=0, YCoordinate=0, ZCoordinate=0)
lunghezza_trave_principale = Panel("8.5")
unit_x = UnitX(Factor=lunghezza_trave_principale)
move = Move(Geometry=construct_point, Motion=unit_x)  # -> Geometry, Transform
line = Line(StartPoint=construct_point, EndPoint=move.Geometry)
length = Length(Curve=line)
passo_travi_secondarie = Division(A=lunghezza_trave_principale, B="4")
division = Division(A=length, B=passo_travi_secondarie)
numero_di_telai_nella_direzione_y = Slider(5, range=0..10)
interasse_y_telai = Slider(7.5, range=4..8)
divide_curve = DivideCurve(Curve=line, Count=division, Kinks=False)  # -> Points, Tangents, Parameters
polyline = PolyLine(Vertices=divide_curve.Points, Closed=False)
multiplication = Multiplication(A=numero_di_telai_nella_direzione_y, B=interasse_y_telai)
construct_domain = ConstructDomain(DomainStart=0, DomainEnd=multiplication)
division_2 = Division(A=multiplication, B=interasse_y_telai)
addition = Addition(A=lunghezza_trave_principale, B="17")
range = Range(Domain=construct_domain, Steps=division_2)
unit_x_2 = UnitX(Factor=addition)
unit_y = UnitY(Factor=range)
move_2 = Move(Geometry=polyline, Motion=unit_y)  # -> Geometry, Transform
explode = Explode(Curve=move_2.Geometry, Recursive=True)  # -> Segments, simplify(Vertices)
flip_matrix = FlipMatrix(Data=explode.Vertices)  # -> simplify(Data)
polyline_2 = PolyLine(Vertices=flip_matrix, Closed=False)
explode_2 = Explode(Curve=polyline_2, Recursive=True)  # -> Segments, Vertices
orditura_x = Curve(simplify(explode.Segments))
orditura_y = Curve(simplify(explode_2.Segments))
construct_domain_2 = ConstructDomain(DomainStart=Slider(20, range=0..100), DomainEnd=Slider(24, range=0..24))
interasse_piano = Slider(4, range=3..5)
n_di_piani = Slider(4, range=3..30)
construct_domain_3 = ConstructDomain(DomainStart=Slider(0, range=0..100), DomainEnd=Slider(4, range=0..24))
weaverbird_s_mesh_from_lines_weave_back = WeaverbirdsMeshFromLinesWeaveBack(Lines=flatten([orditura_x, orditura_y]), MaximumValence=4)
series = Series(Start=0, Step=interasse_piano, Count=n_di_piani)
unit_z = UnitZ(Factor=series)
division_3 = Division(A="17", B="2")
move_3 = Move(Geometry=weaverbird_s_mesh_from_lines_weave_back, Motion=unit_z)  # -> Geometry, Transform
move_4 = Move(Geometry=move_3.Geometry, Motion=unit_x_2)  # -> Geometry, Transform
warpweft = WarpWeft(Mesh=move_4.Geometry)  # -> Warp, Weft, NakedA, NakedB
deconstruct_mesh = DeconstructMesh(Mesh=move_4.Geometry)  # -> Vertices, Faces, Colours, Normals
flip_matrix_2 = FlipMatrix(Data=deconstruct_mesh.Vertices)
travi_principali = Curve(simplify(warpweft.Weft))
polyline_3 = PolyLine(Vertices=flip_matrix_2, Closed=False)  # -> simplify(Polyline)
travi_secondarie = Curve(simplify(warpweft.Warp))
vector_xyz = VectorXYZ(XComponent=division_3, YComponent=0, ZComponent=Slider(2, range=0..10))  # -> Vector, Length
colonne = Curve(polyline_3)
construct_path = ConstructPath(Indices=Slider(0, range=0..100))
panel = Panel("""6
7
8
9
10
11
12
13
14
15
16
17
18
19
20
21
22
23""")
deconstruct_mesh_2 = DeconstructMesh(Mesh=move_3.Geometry)  # -> Vertices, Faces, Colours, Normals
flip_matrix_3 = FlipMatrix(Data=colonne)
warpweft_2 = WarpWeft(Mesh=move_3.Geometry)  # -> Warp, Weft, NakedA, NakedB
construct_path_2 = ConstructPath(Indices=Slider(0, range=0..100))
flip_matrix_4 = FlipMatrix(Data=deconstruct_mesh_2.Vertices)
polyline_4 = PolyLine(Vertices=flip_matrix_4, Closed=False)  # -> simplify(Polyline)
cull_index = CullIndex(List=flip_matrix_3, Indices=panel, Wrap=True)
split_tree = SplitTree(Data=travi_principali, Masks=flatten(construct_path))  # -> Positive, Negative
split_tree_2 = SplitTree(Data=travi_secondarie, Masks=flatten(construct_path_2))  # -> Positive, Negative
end_points = EndPoints(Curve=cull_index)  # -> Start, End
colonne_2 = Curve(polyline_4)
construct_path_3 = ConstructPath(Indices=Slider(3, range=0..100))
construct_path_4 = ConstructPath(Indices=Slider(3, range=0..100))
panel_2 = Panel("""6
7
8
9
10
11
12
13
14
15
16
17
18
19
20
21
22
23""")
flip_matrix_5 = FlipMatrix(Data=colonne_2)
travi_principali_2 = Curve(simplify(warpweft_2.Warp))
travi_secondarie_2 = Curve(simplify(warpweft_2.Weft))
split_tree_3 = SplitTree(Data=split_tree.Negative, Masks=flatten(construct_path_3))  # -> Positive, Negative
explode_3 = Explode(Curve=cull_index, Recursive=True)  # -> simplify(Segments), Vertices
split_tree_4 = SplitTree(Data=split_tree_2.Negative, Masks=flatten(construct_path_4))  # -> Positive, Negative
end_points_2 = EndPoints(Curve=travi_secondarie_2)  # -> Start, End
t_princ_copertura = Curve(split_tree_3.Positive)
cull_index_2 = CullIndex(List=flip_matrix_5, Indices=panel_2, Wrap=True)

list_item = ListItem(List=cull_index_2, Index=0, Wrap=True)  # -> Item, Item1, Item2, Item3, Item4, Item5, Item6, Item7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
list_item_2 = ListItem(List=cull_index, Index=0, Wrap=True)  # -> Item, Item1, Item2, Item3, Item4, Item5, Item6, Item7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
curve = Curve([list_item.Item2, list_item.Item3, list_item.Item8, list_item.Item9])
curve_2 = Curve([list_item_2.Item2, list_item_2.Item3, list_item_2.Item8, list_item_2.Item9])
graft_tree = GraftTree(Tree=[curve, curve_2], IncludeEmptyLists=True, IncludeNullItems=True)
divide_curve_2 = DivideCurve(Curve=graft_tree, Count=Slider(3, range=0..10), Kinks=False)  # -> Points, Tangents, Parameters
explode_tree = ExplodeTree(Data=simplify(divide_curve_2.Points))  # -> Branch0, Branch1, Branch2, Branch3, Branch4, Branch5, Branch6, Branch7
entwine = Entwine(
    Branch00=explode_tree.Branch0,
    Branch01=explode_tree.Branch2,
    Branch02=explode_tree.Branch4,
    Branch03=explode_tree.Branch6,
    FlattenInputs=True)
entwine_2 = Entwine(
    Branch00=explode_tree.Branch1,
    Branch01=explode_tree.Branch3,
    Branch02=explode_tree.Branch5,
    Branch03=explode_tree.Branch7,
    FlattenInputs=True)
shift_list = ShiftList(List=entwine, Shift=1, Wrap=invert(True))
shift_list_2 = ShiftList(List=entwine_2, Shift=1, Wrap=invert(True))
line_2 = Line(StartPoint=entwine_2, EndPoint=shift_list)
line_3 = Line(StartPoint=entwine, EndPoint=shift_list_2)
cull_index_3 = CullIndex(List=line_2, Indices=Slider(3, range=0..10), Wrap=True)
cull_index_4 = CullIndex(List=line_3, Indices=Slider(3, range=0..10), Wrap=True)
curve_3 = Curve([cull_index_3, cull_index_4])

remove_duplicate_lines_karamba3d = RemoveDuplicateLinesKaramba3D(Line=curve_3, LimitDistance=0.005)  # -> OutLine, Info, Indexes
end_points_3 = EndPoints(Curve=cull_index_2)  # -> Start, End
t_principale = Curve(split_tree_3.Negative)
construct_path_5 = ConstructPath(Indices=Slider(0, range=0..100))
curve_4 = Curve(explode_3.Segments)
construct_path_6 = ConstructPath(Indices=Slider(0, range=0..100))
t_sec_copertura = Curve(split_tree_4.Positive)
sub_list = SubList(List=t_sec_copertura, Domain=construct_domain_3, Wrap=True)  # -> List, Index
curve_5 = Curve(sub_list.List)
explode_4 = Explode(Curve=curve_5, Recursive=True)  # -> Segments, flatten(Vertices)
remove_duplicate_points_karamba3d = RemoveDuplicatePointsKaramba3D(Point=explode_4.Vertices, LimitDistance=0.005)  # -> OutPoint, Info, Indexes
t_secondaria = Curve(split_tree_4.Negative)
construct_path_7 = ConstructPath(Indices=Slider(3, range=0..100))
construct_path_8 = ConstructPath(Indices=Slider(3, range=0..100))
explode_5 = Explode(Curve=cull_index_2, Recursive=True)  # -> simplify(Segments), Vertices
split_tree_5 = SplitTree(Data=travi_principali_2, Masks=flatten(construct_path_6))  # -> Positive, Negative
split_tree_6 = SplitTree(Data=travi_secondarie_2, Masks=flatten(construct_path_5))  # -> Positive, Negative
split_tree_7 = SplitTree(Data=split_tree_6.Negative, Masks=flatten(construct_path_7))  # -> Positive, Negative
split_tree_8 = SplitTree(Data=split_tree_5.Negative, Masks=flatten(construct_path_8))  # -> Positive, Negative
curve_6 = Curve(explode_5.Segments)
number_slider = Slider(1, range=0..10)
t_princ_copertura_2 = Curve(split_tree_7.Positive)
t_sec_copertura_2 = Curve(split_tree_8.Positive)
sub_list_2 = SubList(List=t_sec_copertura_2, Domain=construct_domain_2, Wrap=True)  # -> List, Index
curve_7 = Curve(sub_list_2.List)
explode_6 = Explode(Curve=curve_7, Recursive=True)  # -> Segments, flatten(Vertices)
remove_duplicate_points_karamba3d_2 = RemoveDuplicatePointsKaramba3D(Point=explode_6.Vertices, LimitDistance=0.005)  # -> OutPoint, Info, Indexes
move_5 = Move(Geometry=remove_duplicate_points_karamba3d_2.OutPoint, Motion=vector_xyz.Vector)  # -> Geometry, Transform
entwine_3 = Entwine(
    Branch00=remove_duplicate_points_karamba3d_2.OutPoint,
    Branch01=move_5.Geometry,
    Branch02=remove_duplicate_points_karamba3d.OutPoint,
    FlattenInputs=True)
flip_matrix_6 = FlipMatrix(Data=entwine_3)
line_4 = Line(StartPoint=remove_duplicate_points_karamba3d_2.OutPoint, EndPoint=remove_duplicate_points_karamba3d.OutPoint)
interpolate = Interpolate(Vertices=flip_matrix_6, Degree=Slider(2, range=0..10), Periodic=False, KnotStyle=1)  # -> Curve, Length, Domain
number_slider_2 = Slider(8, range=0..100)
number_slider_3 = Slider(1, range=0..10)
curve_8 = Curve(interpolate.Curve)
subtraction = Subtraction(A=number_slider_2, B=number_slider_3)
divide_curve_3 = DivideCurve(Curve=curve_8, Count=number_slider_2, Kinks=False)  # -> Points, Tangents, Parameters
divide_curve_4 = DivideCurve(Curve=line_4, Count=number_slider_2, Kinks=False)  # -> Points, Tangents, Parameters
construct_domain_4 = ConstructDomain(DomainStart=number_slider_3, DomainEnd=subtraction)
sub_list_3 = SubList(List=divide_curve_4.Points, Domain=construct_domain_4, Wrap=True)  # -> List, Index
line_sdl = LineSDL(Start=sub_list_3.List, Direction=Vector(0, 0, 1), Length=Slider(3, range=0..10))
sub_list_4 = SubList(List=divide_curve_3.Points, Domain=construct_domain_4, Wrap=True)  # -> List, Index
trave = Shatter(Curve=line_4, Parameters=divide_curve_4.Parameters)
number_slider_4 = Slider(0, range=0..100)
curve_line = CurveLine(Curve=graft(interpolate.Curve), Line=line_sdl)  # -> flatten(Points), flatten(Params), Count
point = Point(flatten(sub_list_3.List))
flip_matrix_7 = FlipMatrix(Data=sub_list_3.List)
t_secondarie_1 = Curve([split_tree_8.Negative, t_secondaria])
t_primarie_2 = Curve([split_tree_7.Negative, t_principale])
entwine_4 = Entwine(Branch00=t_princ_copertura_2, Branch01=t_princ_copertura, FlattenInputs=True)
entwine_5 = Entwine(Branch00=t_sec_copertura_2, Branch01=t_sec_copertura, FlattenInputs=True)
colonne_3 = Curve([curve_6, curve_4])
pennini = Line(StartPoint=point, EndPoint=curve_line.Points)
point_2 = Point(sub_list_3.List)
flip_matrix_8 = FlipMatrix(Data=point_2)
# Domenico GUARDA QUI
polyline_5 = PolyLine(Vertices=flip_matrix_7, Closed=False)
polyline_6 = PolyLine(Vertices=flip_matrix_8, Closed=False)
point_list = PointList(Points=simplify(flip_matrix_8), Size=Slider(2, range=0..10))
explode_7 = Explode(Curve=polyline_5, Recursive=True)  # -> Segments, Vertices
explode_8 = Explode(Curve=polyline_6, Recursive=True)  # -> Segments, Vertices
spessore = Slider(0.012, range=0..0.1)
diametro_esterno = Slider(0.2191, range=0..1)
diametro_esterno_2 = Slider(0.01, range=0..1)
multiplication_2 = Multiplication(A=spessore, B="2")
subtraction_2 = Subtraction(A=diametro_esterno, B=multiplication_2)
createcircularprofile = CreateCircularProfile(Diameter=diametro_esterno, Catalog=1, DiameterHole=subtraction_2)
createcircularprofile_2 = CreateCircularProfile(Diameter=diametro_esterno_2, Catalog=1, DiameterHole=Slider(0, range=0..100))
spessore_2 = Slider(0.016, range=0..0.1)
material = Material(Name="S235", Type=0)
diametro_esterno_3 = Slider(0.4064, range=0..1)
multiplication_3 = Multiplication(A=spessore_2, B="2")
profile_by_name = ProfileByName(ProfileName="HE260A", Catalog=1)
profile_by_name_2 = ProfileByName(ProfileName="UPN220", Catalog=1)
profile_by_name_3 = ProfileByName(ProfileName="IPE220", Catalog=1)
subtraction_3 = Subtraction(A=diametro_esterno_3, B=multiplication_3)
material_2 = Material(Name="S235", Type=9)
material_3 = Material(Name="S235", Type=9)
profile_by_name_4 = ProfileByName(ProfileName="HE360B", Catalog=1)
createcircularprofile_3 = CreateCircularProfile(Diameter=diametro_esterno_3, Catalog=1, DiameterHole=subtraction_3)
beam = Beam(
    Profile=createcircularprofile,
    Curve=interpolate.Curve,
    Name="Arco",
    ZOffset=0,
    YOffset=0,
    StartExtension=0,
    EndExtension=0,
    JustificationZ=1,
    JustificationY=1,
    Material=material_2)  # -> flatten(Element), flatten(Geometry)
beam_2 = Beam(
    Profile=createcircularprofile_2,
    Curve=pennini,
    Name="Cavi",
    ZOffset=0,
    YOffset=0,
    StartExtension=0,
    EndExtension=0,
    JustificationZ=1,
    JustificationY=1,
    Material=material_3)  # -> flatten(Element), flatten(Geometry)
profile_by_name_5 = ProfileByName(ProfileName="HE320A", Catalog=1)
beam_3 = Beam(
    Profile=profile_by_name,
    Curve=trave,
    Name="T.P.Copertura2",
    ZOffset=0,
    YOffset=0,
    StartExtension=0,
    EndExtension=0,
    JustificationZ=1,
    JustificationY=1,
    Material=material)  # -> flatten(Element), flatten(Geometry)
cable = Cable(Curve=pennini, Diameter=Slider(0.012, range=0..0.1), Name="Cavi")  # -> flatten(Element), graft(Geometry); disabled
profile_by_name_6 = ProfileByName(ProfileName="HE260A", Catalog=1)
profile_by_name_7 = ProfileByName(ProfileName="IPE220", Catalog=1)
profile_by_name_8 = ProfileByName(ProfileName="HE260A", Catalog=1)
beam_4 = Beam(
    Profile=profile_by_name_2,
    Curve=remove_duplicate_lines_karamba3d.OutLine,
    Name="Controventi",
    ZOffset=0,
    YOffset=0,
    StartExtension=0,
    EndExtension=0,
    JustificationZ=1,
    JustificationY=1,
    Material=material)  # -> flatten(Element), flatten(Geometry)
beam_5 = Beam(
    Profile=profile_by_name_3,
    Curve=explode_8.Segments,
    Name="ARCARECCI",
    ZOffset=0,
    YOffset=0,
    StartExtension=0,
    EndExtension=0,
    JustificationZ=1,
    JustificationY=1,
    Material=material)  # -> flatten(Element), flatten(Geometry)
column = Column(Profile=createcircularprofile_3, Curve=colonne_3, Name="Colonne1", Material=material)  # -> flatten(Element), flatten(Geometry)
beam_6 = Beam(
    Profile=profile_by_name_5,
    Curve=t_primarie_2,
    Name="T.P.telaio",
    ZOffset=0,
    YOffset=0,
    StartExtension=0,
    EndExtension=0,
    JustificationZ=1,
    JustificationY=1,
    Material=material)  # -> flatten(Element), flatten(Geometry)
beam_7 = Beam(
    Profile=profile_by_name_6,
    Curve=t_secondarie_1,
    Name="T.S.telaio",
    ZOffset=0,
    YOffset=0,
    StartExtension=0,
    EndExtension=0,
    JustificationZ=1,
    JustificationY=1,
    Material=material)  # -> flatten(Element), flatten(Geometry)
beam_8 = Beam(
    Profile=profile_by_name_7,
    Curve=entwine_5,
    Name="T.S.Copertura1",
    ZOffset=0,
    YOffset=0,
    StartExtension=0,
    EndExtension=0,
    JustificationZ=1,
    JustificationY=1,
    Material=material)  # -> flatten(Element), flatten(Geometry)
beam_9 = Beam(
    Profile=profile_by_name_8,
    Curve=entwine_4,
    Name="T.P.Copertura1",
    ZOffset=0,
    YOffset=0,
    StartExtension=0,
    EndExtension=0,
    JustificationZ=1,
    JustificationY=1,
    Material=material)  # -> flatten(Element), flatten(Geometry)
column_2 = Column(Element=column.Element)  # -> Element, Profile, Curve, Name, Rotation_Degrees, TopOffset, BottomOffset, Material, Attributes, Geometry
cable_2 = Cable(Element=cable.Element)  # -> Element, Curve, Diameter, Name, Material, Attributes, Geometry
number_slider_5 = Slider(8, range=0..10)
addition_2 = Addition(A=number_slider_5, B="37.5")
negative = Negative(Value=number_slider_5)
addition_3 = Addition(A=number_slider_5, B=addition_2)
vector_xyz_2 = VectorXYZ(XComponent=0, YComponent=negative, ZComponent=0)  # -> Vector, Length
number_slider_6 = Slider(8.5, range=0..10)
unit_y_2 = UnitY(Factor=1)
addition_4 = Addition(A=number_slider_5, B="34")
vector_xyz_3 = VectorXYZ(XComponent=negative, YComponent=0, ZComponent=0)  # -> Vector, Length
unit_x_3 = UnitX(Factor=1)
addition_5 = Addition(A=number_slider_6, B="17")
series_2 = Series(Start=Slider(0, range=0..100), Step=Slider(7.5, range=0..10), Count=Slider(6, range=0..10))
addition_6 = Addition(A=number_slider_5, B=addition_4)
line_sdl_2 = LineSDL(Start=vector_xyz_2.Vector, Direction=unit_y_2, Length=addition_3)
unit_x_4 = UnitX(Factor=number_slider_6)
line_sdl_3 = LineSDL(Start=vector_xyz_3.Vector, Direction=unit_x_3, Length=addition_6)
unit_x_5 = UnitX(Factor=addition_5)
unit_y_3 = UnitY(Factor=series_2)
move_6 = Move(Geometry=line_sdl_2, Motion=unit_x_4)  # -> Geometry, Transform
move_7 = Move(Geometry=line_sdl_3, Motion=unit_y_3)  # -> Geometry, Transform
move_8 = Move(Geometry=[move_6.Geometry, line_sdl_2], Motion=unit_x_5)  # -> Geometry, Transform
entwine_6 = Entwine(Branch00=line_sdl_2, Branch01=move_6.Geometry, Branch02=move_8.Geometry, FlattenInputs=True)
select_model = SelectModel(setid="5cb612a59b594f00041f737a")
curve_9 = Curve(move_7.Geometry)
number_slider_7 = Slider(0, range=0..100)
number_slider_8 = Slider(4, range=0..100)
number_slider_9 = Slider(8, range=0..100)
number_slider_10 = Slider(12, range=0..100)
graft_tree_2 = GraftTree(Tree=curve_9, IncludeEmptyLists=True, IncludeNullItems=True)
panel_3 = Panel(number_slider_7)
panel_4 = Panel(number_slider_8)
panel_5 = Panel(number_slider_9)
panel_6 = Panel(number_slider_10)
graft_tree_3 = GraftTree(Tree=entwine_6, IncludeEmptyLists=True, IncludeNullItems=True)
construct_domain_5 = ConstructDomain(DomainStart=Slider(0, range=0..100), DomainEnd=Slider(5, range=0..10))
number_slider_11 = Slider(4, range=0..10)
level = Level(Height=number_slider_7, Name=panel_3)
panel_7 = Panel("""A
B
C
D
E
F
G
H
I
L
M
N
O
P
Q
R
S
T
U
V
Z""")
level_2 = Level(Height=number_slider_8, Name=panel_4)
level_3 = Level(Height=number_slider_9, Name=panel_5)
level_4 = Level(Height=number_slider_10, Name=panel_6)
panel_8 = Panel("4")
subtraction_4 = Subtraction(A=number_slider_11, B=Slider(1, range=0..1))
construct_domain_6 = ConstructDomain(DomainStart=Slider(1, range=0..100), DomainEnd=number_slider_11)
sub_list_5 = SubList(List=panel_7, Domain=construct_domain_5, Wrap=True)  # -> List, Index
entwine_7 = Entwine(Branch00=level, Branch01=level_2, Branch02=level_3, Branch03=level_4, FlattenInputs=True)  # disabled
range_2 = Range(Domain=construct_domain_6, Steps=subtraction_4)
grid = Grid(Curve=graft_tree_2, Name=graft(sub_list_5.List))
panel_9 = Panel(range_2)
number_slider_12 = Slider(1, range=0..1)
text_split = TextSplit(Text=panel_9, Separators=".")
dispatch = Dispatch(List=text_split, DispatchPattern=[True, False])  # -> ListA, ListB
grid_2 = Grid(Curve=graft_tree_3, Name=graft(dispatch.ListA))
panel_10 = Panel(dispatch.ListA)
entwine_8 = Entwine(Branch00=grid, Branch01=grid_2, FlattenInputs=True)
grid_3 = Grid(Element=entwine_8)  # -> Element, Attributes, Curve, Name; disabled

point_3 = Point(sub_list_4.List)
flip_matrix_9 = FlipMatrix(Data=point_3)
polyline_7 = PolyLine(Vertices=flip_matrix_9, Closed=False)
explode_9 = Explode(Curve=polyline_7, Recursive=True)  # -> Segments, Vertices
join_curves = JoinCurves(Curves=explode_9.Segments, Preserve=False)
loft = Loft(
    Curves=flatten(join_curves),
    Options={Adjust=False, Closed=False, LoftEnds=0, LoftSimp=0, LoftType=0, Rebuild=10, Refit=0.01})
point_on_curve = PointOnCurve(explode_9.Segments, parameter=0.924)
surface = Surface(reparameterize(loft))
surface_closest_point = SurfaceClosestPoint(Point=point_on_curve, Surface=surface)  # -> Point, UVPoint, Distance
unit_z_2 = UnitZ(Factor=1)
profile_by_name_9 = ProfileByName(ProfileName="IPE220", Catalog=1)

evaluate_surface = EvaluateSurface(Surface=graft(surface), Point=surface_closest_point.UVPoint)  # -> Point, Normal, Frame

vector = Vector(evaluate_surface.Normal)
deconstruct_vector = DeconstructVector(Vector=vector)  # -> XComponent, YComponent, ZComponent
smaller_than = SmallerThan(FirstNumber=deconstruct_vector.XComponent, SecondNumber="0.01")  # -> SmallerThan, OrEqualTo
angle = Angle(VectorA=evaluate_surface.Normal, VectorB=unit_z_2)  # -> Angle, Reflex
pick_n_choose = PickNChoose(Pattern=smaller_than.SmallerThan, Stream0=angle.Angle, Stream1=angle.Reflex)
degrees = Degrees(Radians=pick_n_choose)
beam_10 = Beam(
    Profile=profile_by_name_9,
    Curve=explode_9.Segments,
    Name="T.S.Copertura2",
    Rotation_Degrees=degrees,
    ZOffset=0,
    YOffset=0,
    StartExtension=0,
    EndExtension=0,
    JustificationZ=1,
    JustificationY=1,
    Material=material)  # -> flatten(Element), flatten(Geometry); disabled

entwine_9 = Entwine(
    Branch00=beam_9.Element,
    Branch01=beam_8.Element,
    Branch02=beam_7.Element,
    Branch03=beam_6.Element,
    Branch04=beam.Element,
    Branch05=beam_3.Element,
    Branch06=beam_10.Element,
    FlattenInputs=True)
beam_11 = Beam(Element=entwine_9)  # -> Element, Profile, Curve, Name, Rotation_Degrees, ZOffset, YOffset, StartExtension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
entwine_10 = Entwine(
    Branch00=column_2.Element,
    Branch01=beam_11.Element,
    Branch02=cable_2.Element,
    Branch03=grid_3.Element,
    Branch04=entwine_7,
    Branch05=beam_4.Element,
    Branch06=beam_5.Element,
    Branch07=beam_2.Element,
    FlattenInputs=True)
element_ids = ElementIDs(Element=entwine_10)  # -> KonstruID, RevitID, SAPID, ETABSID, RAMID, TeklaID, GrasshopperID, RhinoID, DynamoID
upload_konstru = UploadKonstru(ModelID=select_model, Upload=Button(), Message="Tecnica2", AddOrUpdateElements=flatten(entwine_10))
