# Grasshopper definition reticolare spaziale.gh (Grasshopper 0.9.76)

plane_surface = PlaneSurface(Plane=PlaneXY(0, 0, 0), XSize=Slider(20, range=0..100), YSize=Slider(61, range=0..100))
divide_surface = DivideSurface(Surface=plane_surface, UCount=10, VCount=10)  # -> Points, Normals, Parameters
flip = FlipMatrix(Data=divide_surface.Points)
polyline = PolyLine(Vertices=flip, Closed=False)
polyline_2 = PolyLine(Vertices=divide_surface.Points, Closed=False)
divide = DivideDomain²(Domain=plane_surface, UCount=10, VCount=10)
subsrf = Isotrim(Surface=plane_surface, Domain=divide)
md_slider = MDSlider(slider_value=Point(0.5, 0.5, 0.5), SliderMode=0, x_domain=Domain(0, 1), y_domain=Domain(0, 1), z_domain=Domain(0, 1))
debrep = DeconstructBrep(Brep=subsrf)  # -> Faces, Edges, Vertices
evalsrf = EvaluateSurface(Surface=reparameterize(debrep.Faces), Point=md_slider)  # -> Point, Normal, Frame
neg = Negative(Value=Slider(1.5, range=0..10))
line = LineSDL(Start=evalsrf.Point, Direction=evalsrf.Normal, Length=neg)
end = EndPoints(Curve=line)  # -> Start, End
pt = Point(flatten(end.End))
partition = PartitionList(List=pt, Size=Slider(10, range=0..10))
points = PointList(Points=pt, Size=Slider(0.25, range=0..1))
ln = Line(StartPoint=end.End, EndPoint=debrep.Vertices)
flip_2 = FlipMatrix(Data=partition)
polyline_3 = PolyLine(Vertices=partition, Closed=False)
polyline_4 = PolyLine(Vertices=flip_2, Closed=False)
explode = Explode(Curve=polyline_4, Recursive=True)  # -> Segments, Vertices
merge = Merge(Data1=polyline_3, Data2=polyline_4, Data3=ln, Data4=polyline_2, Data5=polyline)
explode_2 = Explode(Curve=simplify(flatten(merge)), Recursive=True)  # -> simplify(flatten(Segments)), simplify(flatten(Vertices))
panel = Panel(explode_2.Vertices)
