# Grasshopper definition trave con saette.gh (Grasshopper 0.9.76)
# plug-ins: Karamba, Human

lunghezza_trave = Panel("8.5")
X = UnitX(Factor=lunghezza_trave)
pt = ConstructPoint(XCoordinate=0, YCoordinate=0, ZCoordinate=0)
move = Move(Geometry=pt, Motion=X)  # -> Geometry, Transform
ln = Line(StartPoint=pt, EndPoint=move.Geometry)
end = EndPoints(Curve=ln)  # -> Start, End
neg = Negative(Value=Slider(1, range=0..1))
entwine = Entwine(Branch00=end.Start, Branch01=end.End, FlattenInputs=True)
divide = DivideCurve(Curve=ln, Count=Slider(4, range=0..10), Kinks=False)  # -> Points, Tangents, Parameters
Z = UnitZ(Factor=neg)
move_2 = Move(Geometry=entwine, Motion=Z)  # -> Geometry, Transform
item = ListItem(List=divide.Points, Index=0, Wrap=True)  # -> Item, Item1, Item2, Item3, Item4
pt_2 = Point(flatten([item.Item1, item.Item2, item.Item3]))
entwine_2 = Entwine(
    Branch00=item.Item,
    Branch01=item.Item1,
    Branch02=item.Item2,
    Branch03=item.Item3,
    Branch04=item.Item4,
    FlattenInputs=True)
shatter = Shatter(Curve=ln, Parameters=divide.Parameters)
crosecselect = CrossSectionSelectorKaramba3D(NameOrListIndexOfCrossSection="HEA260")  # -> CrossSection, Info
crosecselect_2 = CrossSectionSelectorKaramba3D(NameOrListIndexOfCrossSection="HEA260")  # -> CrossSection, Info
trave = Panel("ARCO")
trave_2 = Panel("ARCO")
linetobeam = LineToBeamKaramba(Line=shatter, Identifier=trave, CrossSection=crosecselect.CrossSection, New=True, Remove=True, LimitDistance_m=0.005)  # -> Element, Points, Info
linetobeam_2 = LineToBeamKaramba(Line=shatter, Identifier=trave_2, CrossSection=crosecselect_2.CrossSection, New=True, Remove=True, LimitDistance_m=0.005)  # -> Element, Points, Info
vincoli = Point([pt, move.Geometry])
rdpoints = RemoveDuplicatePointsKaramba3D(Point=linetobeam.Points, LimitDistance=0.005)  # -> graft(OutPoint), Info, Indexes
supp = SupportKaramba(PosInd=vincoli, menu=[buttons(off, on, on, on, off, on)])  # -> flatten(Support)
supp_2 = SupportKaramba(menu=[buttons(on, on, on, on, off, on)])  # -> flatten(Support)
entwine_3 = Entwine(Branch00=linetobeam.Element, FlattenInputs=True)
neg_2 = Negative(Value=Slider(133, range=0..1000))
Z_2 = UnitZ(Factor=neg_2)
panel = Panel("TRAVE")
loads = LoadsKaramba(ForceVector=Z_2, Local=False, PosInd=pt_2, LCase="0", mode="Point")
loads_2 = LoadsKaramba(Vector=Vector(0, 0, -1), LCase="0", mode="Gravity")
entwine_4 = Entwine(Branch00=supp_2, Branch01=supp, FlattenInputs=True)
entwine_5 = Entwine(Branch00=loads, Branch01=loads_2, FlattenInputs=True)
assemble = AssembleModelKaramba(
    Points=flatten(entwine_2),
    Elem=flatten(entwine_3),
    Support=flatten(entwine_4),
    Load=flatten(entwine_5),
    LimitDistance_m=0.005)  # -> Model, Info, Mass_kg, CenterOfGravity
analyzethi = AnalyzeThIKaramba(Model=assemble.Model)  # -> CalculatedModel, flatten(MaximumDisplacement_m), ResultingForceOfGravity_kN, ElasticEnergy_kNm
colours = LegendColour()
modelview = ModelViewKaramba(
    Model=analyzethi.CalculatedModel,
    LoadCaseFactorsForLinearSuperposition=1,
    IndexOfVisibleLoadcase=-1,
    ListOfColorsForColoringPlots=colours)  # -> Model, DeformedMesh, DeformedAxes, DeformedModel
item_2 = ListItem(List=analyzethi.MaximumDisplacement_m, Index=0, Wrap=True)
division = Division(B=Slider(500, range=0..1000))
beamview = BeamViewKaramba(Model=modelview.Model)  # -> Model, MeshesOfRenderedBeams, DeformedBeamAxes, LegendColors, LegendTags
f_sle_rara = Panel(item_2)
fmax = Panel(division)
b_forces = BeamForcesKaramba(AnalyzedModel=beamview.Model, LCase=-1, MaximumDistanceBetweenResults_m=-1, NumberOfResultsPerBeamElement="1")  # -> AnalyzedModel, NormalForce_kN, ShearForceVz_kN, ShearForceVy_kN, BendingMomentMt_kNm, BendingMomentMy_kNm, BendingMomentMz_kNm
nodedisp = NodalDisplacementsKaramba3D(AnalyzedModel=beamview.Model, LoadCase=0)  # -> AnalyzedModel, NodalTranslations_m, NodalRotations_rad
multiplication = Multiplication(A=f_sle_rara, B=Slider(1000, range=0..1000))
multiplication_2 = Multiplication(A=fmax, B=Slider(1000, range=0..1000))
N = Panel(b_forces.NormalForce_kN)
vx_vy_w = Panel(nodedisp.NodalTranslations_m)
V = Panel(b_forces.ShearForceVz_kN)
react = ReactionForcesKaramba3D(AnalyzedModel=beamview.Model, LoadCase=0)  # -> AnalyzedModel, ReactionForces_kN, ReactionMoments_kNm, SupportPosition, SumOfReactionForces_kN, SumOfReactionMoments_kNm
M = Panel(b_forces.BendingMomentMy_kNm)
item_3 = ListItem(List=flatten(assemble.Mass_kg), Index=0, Wrap=True)
num = Number(expr("Round(x,2)", multiplication_2))
num_2 = Number(expr("Round(x,2)", multiplication))
num_3 = Number(expr("Round(x,2)", item_3))

# ---- group: Performance parameters
header = Panel("""displacement max:
  L/500:  
Mass:""")
entwine_6 = Entwine(Branch00=num_2, Branch01=num, Branch02=num_3, FlattenInputs=True)  # -> flatten(Result)
units = Panel("""  [mm]
  [mm]
  [Kg]""")
concat = Concatenate(FragmentA=header, FragmentB=entwine_6, FragmentC=units)
txt = Text(concat)
panel_2 = Panel(txt)
lng = ListLength(List=txt)
series = Series(Start=Slider(53, range=0..100), Step=Slider(29, range=0..100), Count=lng)
pt_3 = ConstructPoint(XCoordinate=Slider(17, range=0..1000), YCoordinate=series, ZCoordinate=0)
texttoscreen = RenderTextToScreen(
    Text=txt,
    Location=pt_3,
    Size=Slider(9, range=0..100),
    Color=ColourSwatch(SwatchColor=RGB(255, 255, 255)),
    m_scWithvp=False)

# ==== cluster LegendColour: Legend colour for Karamba
merge = Merge(
    Data1=ColourSwatch(SwatchColor=RGB(255, 0, 0)),
    Data2=ColourSwatch(SwatchColor=RGB(255, 179, 0)),
    Data3=ColourSwatch(SwatchColor=RGB(255, 255, 0)),
    Data4=ColourSwatch(SwatchColor=RGB(0, 255, 0)),
    Data5=ColourSwatch(SwatchColor=RGB(0, 255, 255)),
    Data6=ColourSwatch(SwatchColor=RGB(4, 177, 255)),
    Data7=ColourSwatch(SwatchColor=RGB(0, 0, 255)),
    Data8=ColourSwatch(SwatchColor=RGB(129, 0, 190)),
    Data9=ColourSwatch(SwatchColor=RGB(75, 0, 130)))  # -> reverse(Result)
legend = ClusterOutput(merge)  # List of colours to plug on Karamba Legend
