# Grasshopper definition Cantilever.gh (Grasshopper 1.0.7)
# plug-ins: Human

curve = Curve([<curve referenced from the Rhino model> x5, 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])
curve_2 = Curve([<curve referenced from the Rhino model> x2])
boundary_surfaces = BoundarySurfaces(Edges=curve_2)
boundary_surfaces_2 = BoundarySurfaces(Edges=curve)
number_slider = Slider(0.3, range=0..1)
number_slider_2 = Slider(1, range=0..10)
brep_join = BrepJoin(Breps=boundary_surfaces)  # -> Breps, Closed
area = Area(Geometry=brep_join.Breps)  # -> Area, Centroid
rectangle = Rectangle(Plane=PlaneXY(0, 0, 0), XSize=number_slider_2, YSize=number_slider, Radius=0)  # -> Rectangle, Length
division = Division(A=[number_slider_2, number_slider], B="2")
numero_piani = Slider(10, range=0..100)
h_interpiano = Panel("4")
surface = Surface(rectangle.Rectangle)
vector_xyz = VectorXYZ(XComponent=0, YComponent=0, ZComponent=0)  # -> Vector, Length
brep = Brep(surface)
divide_length = DivideLength(Length=Slider(1, range=0..1))  # -> Points, Tangents, Parameters
multiplication = Multiplication(A=numero_piani, B=h_interpiano)
vector_xyz_2 = VectorXYZ(XComponent="2", YComponent=0, ZComponent=0)  # -> Vector, Length
vector_xyz_3 = VectorXYZ(XComponent="10", YComponent=0, ZComponent=0)  # -> Vector, Length
unit_z = UnitZ(Factor=multiplication)
vector_xyz_4 = VectorXYZ(XComponent=Slider(10, range=0..100), YComponent="2", ZComponent=0)  # -> Vector, Length
multiplication_2 = Multiplication(A=vector_xyz_2.Vector, B=Slider(3, range=0..10))
move = Move(Geometry=boundary_surfaces_2, Motion=vector_xyz_3.Vector)  # -> Geometry, Transform
area_2 = Area(Geometry=move.Geometry)  # -> Area, Centroid
move_2 = Move(Geometry=area_2.Centroid, Motion=unit_z)  # -> Geometry, Transform
brep_2 = Brep(move.Geometry)
negative = Negative(Value=vector_xyz_4.Vector)
line = Line(StartPoint=area_2.Centroid, EndPoint=move_2.Geometry)
move_3 = Move(Geometry=divide_length.Points, Motion=negative)  # -> Geometry, Transform
length = Length(Curve=line)
division_2 = Division(A=length, B="350")
number_slider_3 = Slider(3, range=0..10)
panel = Panel(division_2)
vector_display_ex = VectorDisplayEx(
    Point=move_3.Geometry,
    Vector=multiplication_2,
    Colour=ColourSwatch(SwatchColor=RGBA(255, 0, 0, 213)),
    Width=Slider(1, range=0..1))
number_slider_4 = Slider(0.1, range=0..0.1)
cantilever_l_e_bending = GhPythonScript(
    young_Modul="25000",
    Curve=line,
    section=brep_2,
    p1="19.8",
    divideDistance=Slider(1, range=0..1),
    scaleDef=Slider(1000, range=0..1000))  # -> out, trasl1, rot, sectionDef, sectionBrep, Model, TotalVector, totalPoint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; inputs Curve: Curve, section: Brep, scaleDef: Int32
# ---------- cantilever_l_e_bending: Python ----------
import Rhino.Geometry as rg
import ghpythonlib.components as ghcomp
import math as mt


## ASCISSA ##

def linspace(a, b, n=100):
    if n < 2:
        return b
    diff = (float(b) - a)/(n - 1)
    return [diff * i + a  for i in range(n)]

startPoint =  Curve.PointAtNormalizedLength(0.0)
parameterStart = Curve.ClosestPoint(startPoint, 0.01)[1]
planeStart = Curve.PerpendicularFrameAt(parameterStart)[1]

DivCurve = ghcomp.DivideDistance(Curve,divideDistance)
PointsDivLength = DivCurve[0]

H = ghcomp.Length(Curve)
propSection = rg.AreaMassProperties.Compute( section)
Area = propSection.Area
I1 = propSection.CentroidCoordinatesMomentsOfInertia[1]
I2 = propSection.CentroidCoordinatesMomentsOfInertia[0]
I3 = propSection.CentroidCoordinatesMomentsOfInertia[2]

zi = linspace( 0, H, len( PointsDivLength ))
axis1 = planeStart[1]
axis2 = planeStart[2]
axis3 = planeStart[3]

E = young_Modul*1000

trasl1 = []
transPoint = []
sectionDef = []
sectionBrep = []
sectionModel = []
Model= []
TotalVector = []
totalPoint = []
wirframe = []
sigma = []
wirframe2 = []
sigma2 = []
for index, z in enumerate(zi):
    
    v1= p1*z**2*(6*H**2 - 4*H*z + z**2)/(24*E*I1)
    v1Vector = v1*axis1
    
    r2 = p1*z*(3*H**2 - 3*H*z + z**2)/(6*E*I1)
   
    trasl1.append( v1Vector )
    MovDefpoint = ghcomp.Move(PointsDivLength[index], scaleDef*v1Vector)[0]
    transPoint.append( MovDefpoint )
    
    sectionPlane = ghcomp.Move(section, rg.Vector3d(0,0,z))[0]
    sectionPlane2 = ghcomp.Move(sectionPlane, scaleDef*v1Vector)[0]
    centerRotatation = MovDefpoint
    #sectionPlane.Rotate( scaleDef*r1x, axis1, centerRotatation )
    sectionPlane2.Rotate( scaleDef*r2, axis2, centerRotatation )
    sectionDef.append( sectionPlane2 )
    sectionModel.append(sectionPlane)
    
    
    if index >=  1:
        # Modello deformato
        curveSection1 = ghcomp.DeconstructBrep( sectionDef[index-1] )[1]
        curveSection2 = ghcomp.DeconstructBrep( sectionDef[index] )[1]
        
        # Modello non deformato
        curveModel1 = ghcomp.DeconstructBrep( sectionModel[index - 1] )[1]
        curveModel2 = ghcomp.DeconstructBrep( sectionModel[index] )[1]
        
        no_pt = rg.Point3d.Unset
        norm_loft = rg.LoftType.Normal

        brep1 = []
        brepModel = []
        for i in range(0, len(curveSection1)):
            curve = [  curveSection1[i], curveSection2[i] ]
            breps = rg.Brep.CreateFromLoft(curve,no_pt,no_pt,norm_loft,False)
            brep1.append( breps )
        
            curveModel = [  curveModel1[i], curveModel2[i] ]
            breps = rg.Brep.CreateFromLoft(curveModel,no_pt,no_pt,norm_loft,False)
            brepModel.append( breps )
             
        sectionBrep.append(brep1)
        Model.append(brepModel)
        
        
    M2 = -p1*(H**2 - 2*H*z + z**2)/2
    T2= p1*(-H + z)
    
    ## TENSIONI ##
    pointSurface = ghcomp.PopulateGeometry( sectionPlane, int(Area*200),1)
    totalPoint.append( pointSurface )
    #print(pointSurface)
    vector = []
    for value in pointSurface:
        xc = PointsDivLength[index][0]
        yc = PointsDivLength[index][1]
        sigma1 = M2/I1*( value[0] - xc )
        sigma1Vector = rg.Vector3d( 0, 0, sigma1 )
        vector.append( sigma1Vector )
    TotalVector.append(vector)
    
    # MESH #
 
    #crv = rg.Brep.GetWireframe(sectionPlane, 50)
    crv = ghcomp.DeconstructBrep(sectionPlane)[1]
    
    crv1 = []
    crv2 = []
    
    for index,value in enumerate(crv):
        if index <=3 :
            crv1.append(value)
        else:
            crv2.append(value)
    crvPoint = ghcomp.DivideLength( crv1, 0.50)[0]
    point = rg.Point3d.CullDuplicates( crvPoint, 0.01)
    wirframe.append(point)
    
    sigmaPoint = []
    for value in point:
        sigmaPoint.append( M2/I1*( value[0] - xc ))
    sigma.append( sigmaPoint )
    
    crvPoint = ghcomp.DivideLength( crv2, 0.5)[0]
    point = rg.Point3d.CullDuplicates( crvPoint, 0.01)
    wirframe2.append(point)
    
    sigmaPoint2 = []
    for value in point:
        sigmaPoint2.append( M2/I1*( value[0] - xc ))
    sigma2.append( sigmaPoint2 )




def meshElement(wirframe,sigma):
    sigmaz = []

    meshModel = rg.Mesh()
    for i in range(0,len(wirframe)):
        for j in range(0, len(wirframe[0])):
            
            vertix = wirframe[i][j]
            
            sigmaz.append( sigma[i][j] )
            meshModel.Vertices.Add( vertix ) 
            meshModel.VertexColors.Add(250,200,100);
            
    k = len(wirframe[0])
    
    sigmaVertixValue = []
    for i in range(0,len(wirframe)-1):
        for j in range(0, len(wirframe[0])):
            
            if j < len(wirframe[0])-1:
                
                index1 = i*k + j
                index2 = (i+1)*k + j
                index3 = index2 + 1
                index4 = index1 + 1
                
            elif j == len(wirframe[0])-1:
                index1 = i*k + j
                index2 = (i+1)*k + j
                index3 = (i+1)*k
                index4 = i*k
            
            sigmaVertixValue.append( [ sigmaz[index1], sigmaz[index2], sigmaz[index3], sigmaz[index4] ] )
            meshModel.Faces.AddFace(index1, index2, index3, index4)
    return sigmaz, meshModel

sigmaz,meshModel = meshElement(wirframe,sigma)
sigmaz2,meshModel2 = meshElement(wirframe2,sigma2)
# ---------- end cantilever_l_e_bending ----------
ghpython_script = GhPythonScript(x=cantilever_l_e_bending.meshModel2)  # -> out, a
# ---------- ghpython_script: Python ----------
a = x
# ---------- end ghpython_script ----------
ghpython_script_2 = GhPythonScript(x=cantilever_l_e_bending.sigmaz)  # -> out, simplify(a); same code as ghpython_script
ghpython_script_3 = GhPythonScript(x=ghpython_script.a)  # -> out, simplify(a); same code as ghpython_script
ghpython_script_4 = GhPythonScript(x=cantilever_l_e_bending.meshModel)  # -> out, simplify(a); same code as ghpython_script
geometry = Geometry(ghpython_script_4.a)
ghpython_script_5 = GhPythonScript(x=cantilever_l_e_bending.totalPoint)  # -> out, a; same code as ghpython_script
ghpython_script_6 = GhPythonScript(x=cantilever_l_e_bending.TotalVector)  # -> out, a; same code as ghpython_script
list_to_tree = ListToTree(PythonList=cantilever_l_e_bending.Model)  # -> simplify(DataTree); inputs PythonList: list, BasePath: list of Int32
# ---------- list_to_tree: Python ----------
from Grasshopper import DataTree as Tree
from Grasshopper.Kernel.Data import GH_Path as Path
from System import Array

def list_to_tree(input, none_and_holes=False, base_path=[0]):
    """Transforms nestings of lists or tuples to a Grasshopper DataTree"""
    
    def process_one_item(input,tree,track):
        path = Path(Array[int](track))
        if len(input) == 0 and none_and_holes: tree.EnsurePath(path); return
        for i,item in enumerate(input):
            if hasattr(item, '__iter__'): #if list or tuple
                track.append(i); process_one_item(item,tree,track); track.pop()
            else:
                if none_and_holes: tree.Insert(item,path,i)
                elif item is not None: tree.Add(item,path)
    tree = Tree[object]()
    if input is not None: process_one_item(input,tree,base_path[:]); return tree
    

pythonList = PythonList or []
None_and_holes = False
Base_path = BasePath or [0]


DataTree = list_to_tree(pythonList,none_and_holes = None_and_holes, base_path= Base_path)
# ---------- end list_to_tree ----------
list_to_tree_2 = ListToTree(PythonList=cantilever_l_e_bending.sectionBrep)  # -> simplify(DataTree); inputs PythonList: list, BasePath: list of Int32; same code as list_to_tree
bounds = Bounds(Numbers=flatten(cantilever_l_e_bending.trasl1))
ghpython_script_7 = GhPythonScript(x=ghpython_script_5.a)  # -> out, simplify(a); inputs x: list; same code as ghpython_script
ghpython_script_8 = GhPythonScript(x=ghpython_script_6.a)  # -> out, simplify(a); inputs x: list; same code as ghpython_script
bounds_2 = Bounds(Numbers=flatten([ghpython_script_2.a, cantilever_l_e_bending.sigmaz2]))
division_3 = Division(A="1", B=Slider(10000, range=0..10000))
triangulate = Triangulate(Mesh=cantilever_l_e_bending.meshModel)  # -> Mesh, Count
deconstruct_domain = DeconstructDomain(Domain=bounds)  # -> Start, End
shift_paths = ShiftPaths(Data=list_to_tree_2, Offset=-1)
range = Range(Domain=bounds_2, Steps=Slider(19, range=0..20))
shift_paths_2 = ShiftPaths(Data=list_to_tree, Offset=-1)
point = Point(ghpython_script_7.a)
multiplication_3 = Multiplication(A=ghpython_script_8.a, B=division_3)
deconstruct_domain_2 = DeconstructDomain(Domain=bounds_2)  # -> Start, End
flip_matrix = FlipMatrix(Data=shift_paths)
c_script = CSharpScript(mesh=triangulate.Mesh, values=cantilever_l_e_bending.sigmaz, iso=range)  # -> out, low_mesh, up_mesh, simplify(low_values), up_values, simplify(frontier); inputs mesh: Mesh, values: list of Double, iso: Double
# ---------- c_script: C# ----------
    //This script cut a mesh using an iso-value. Values are put on each vertex of the mesh
    //Developped by Laurent Delrieu
    //1st of September 2015

    Mesh mesh_low = new Mesh();
    Mesh mesh_up = new Mesh();
    List<double> lv = new List<Double>();
    List<double> uv = new List<Double>();
    List<Line> lines = new List<Line>();

    double min;
    double max;
    int A, B, C;

    //For each face
    for(int i = 0;i < _mesh.Faces.Count;i++)
    {
      //It is implied that Mesh has just triangles
      //Here it is looked if iso value in on face
      A = _mesh.Faces[i].A;
      B = _mesh.Faces[i].B;
      C = _mesh.Faces[i].C;
      min = Math.Min(Math.Min(_values[A], _values[B]), _values[C]);
      max = Math.Max(Math.Max(_values[A], _values[B]), _values[C]);

      //If OK there will be a triangulation
      if (isInside(_iso, min, max))
      {
        if (isInside(_iso, _values[A], _values[B]))
        {
          if (isInside(_iso, _values[A], _values[C])) remesh(_mesh, i, _values, _iso, B, A, C, ref mesh_low, ref mesh_up, ref lv, ref uv, ref lines);
          else remesh(_mesh, i, _values, _iso, A, B, C, ref mesh_low, ref mesh_up, ref lv, ref uv, ref lines);
        }
        else    remesh(_mesh, i, _values, _iso, A, C, B, ref mesh_low, ref mesh_up, ref lv, ref uv, ref lines);
      }
      else   add_face(_mesh, i, _values, _iso, A, C, B, ref mesh_low, ref mesh_up, ref lv, ref uv);
    }//End for

    mesh_low.Weld(0.001);
    mesh_low.Normals.ComputeNormals();
    mesh_low.Compact();
    mesh_up.Weld(0.001);
    mesh_up.Normals.ComputeNormals();
    mesh_up.Compact();

    low_mesh = mesh_low;
    up_mesh = mesh_up;
    low_values = lv;
    up_values = uv;

    // Rhino.Geometry.Curve.JoinCurves
    frontier = lines;
# ---------- c_script: C# additional code ----------
  public void remesh(Mesh M, int i, List<double> V, double iso, int A, int B, int C, ref Mesh mesh_low, ref Mesh mesh_up, ref List<double> lv, ref List<double> uv, ref List<Line> lines)
  {
    //M is an input mesh (triangular)
    //V are values on vertex
    //Iso is a value for splitting
    //A B C are indices for splitting segment AB and BC, so if value on B is lower than
    Point3f pAB = new Point3f();
    Point3f pBC = new Point3f();
    int npt;

    pAB = M.Vertices[A] + Vector3f.Multiply((float) ((iso - V[A]) / (V[B] - V[A])), Point3f.Subtract(M.Vertices[B], M.Vertices[A]));
    pBC = M.Vertices[B] + Vector3f.Multiply((float) ((iso - V[B]) / (V[C] - V[B])), Point3f.Subtract(M.Vertices[C], M.Vertices[B]));

    lines.Add(new Line(pAB, pBC));

    if (V[B] <= iso)
    {
      npt = mesh_low.Vertices.Count;
      mesh_low.Vertices.Add(M.Vertices[B]); //npt
      mesh_low.Vertices.Add(pAB); //npt+1
      mesh_low.Vertices.Add(pBC); //npt+2
      mesh_low.Faces.AddFace(npt, npt + 1, npt + 2);
      lv.Add(V[B]);
      lv.Add(iso);
      lv.Add(iso);

      npt = mesh_up.Vertices.Count;
      mesh_up.Vertices.Add(M.Vertices[A]); //npt
      mesh_up.Vertices.Add(pAB); //npt+1
      mesh_up.Vertices.Add(pBC); //npt+2
      mesh_up.Vertices.Add(M.Vertices[C]); //npt+3
      //Meshing of a quandrangle in the best 2 triangles
      if (isBest(M.Vertices[A], pAB, pBC, M.Vertices[C]))
      {
        mesh_up.Faces.AddFace(npt, npt + 1, npt + 2);
        mesh_up.Faces.AddFace(npt + 2, npt + 3, npt);
      }
      else
      {
        mesh_up.Faces.AddFace(npt, npt + 1, npt + 3);
        mesh_up.Faces.AddFace(npt + 1, npt + 2, npt + 3);
      }

      uv.Add(V[A]);
      uv.Add(iso);
      uv.Add(iso);
      uv.Add(V[C]);
    }
    else
    {
      npt = mesh_up.Vertices.Count;
      mesh_up.Vertices.Add(M.Vertices[B]); //npt
      mesh_up.Vertices.Add(pAB); //npt+1
      mesh_up.Vertices.Add(pBC); //npt2
      mesh_up.Faces.AddFace(npt, npt + 1, npt + 2);
      uv.Add(V[B]);
      uv.Add(iso);
      uv.Add(iso);

      npt = mesh_low.Vertices.Count;
      mesh_low.Vertices.Add(M.Vertices[A]); //npt
      mesh_low.Vertices.Add(pAB); //npt+1
      mesh_low.Vertices.Add(pBC); //npt+2
      mesh_low.Vertices.Add(M.Vertices[C]); //npt+3
      if (isBest(M.Vertices[A], pAB, pBC, M.Vertices[C]))
      {
        mesh_low.Faces.AddFace(npt, npt + 1, npt + 2);
        mesh_low.Faces.AddFace(npt + 2, npt + 3, npt);
      }
      else
      {
        mesh_low.Faces.AddFace(npt, npt + 1, npt + 3);
        mesh_low.Faces.AddFace(npt + 1, npt + 2, npt + 3);
      }
      lv.Add(V[A]);
      lv.Add(iso);
      lv.Add(iso);
      lv.Add(V[C]);
    }
  }
  public void add_face(Mesh M, int i, List<double> V, double iso, int A, int B, int C, ref Mesh mesh_low, ref Mesh mesh_up, ref List<double> lv, ref List<double> uv)
  {
    //Value is lower of bigger than ISO

    //M is an input mesh (triangular)
    //V are values on vertex
    //Iso is a value for splitting
    int npt;

    if (V[B] <= iso)
    {
      npt = mesh_low.Vertices.Count;
      mesh_low.Vertices.Add(M.Vertices[A]); //npt
      mesh_low.Vertices.Add(M.Vertices[B]); //npt+1
      mesh_low.Vertices.Add(M.Vertices[C]); //npt+2
      mesh_low.Faces.AddFace(npt, npt + 1, npt + 2);
      lv.Add(V[A]);
      lv.Add(V[B]);
      lv.Add(V[C]);
    }
    else
    {
      npt = mesh_up.Vertices.Count;
      mesh_up.Vertices.Add(M.Vertices[A]); //npt
      mesh_up.Vertices.Add(M.Vertices[B]); //npt+1
      mesh_up.Vertices.Add(M.Vertices[C]); //npt+2
      mesh_up.Faces.AddFace(npt, npt + 1, npt + 2);
      uv.Add(V[A]);
      uv.Add(V[B]);
      uv.Add(V[C]);
    }
  }
  //For a quandrangle done with 4 points the script look at the best solution. So ration of surface between the 2 traingles must be the bigger
  public bool isBest(Point3f pt1, Point3f pt2, Point3f pt3, Point3f pt4)
  {
    bool test = true;
    double d1, d2;
    Vector3d v1_1 = new Vector3d();
    Vector3d v1_2 = new Vector3d();
    Vector3d v2_1 = new Vector3d();
    Vector3d v2_2 = new Vector3d();

    v1_1 = pt2 - pt1;
    v1_2 = pt3 - pt1;
    v2_1 = pt3 - pt1;
    v2_2 = pt4 - pt1;
    d1 = Math.Min(Vector3d.CrossProduct(v1_1, v1_2).Length, Vector3d.CrossProduct(v2_1, v2_2).Length) / Math.Max(Vector3d.CrossProduct(v1_1, v1_2).Length, Vector3d.CrossProduct(v2_1, v2_2).Length);

    v1_1 = pt2 - pt1;
    v1_2 = pt4 - pt1;
    v2_1 = pt2 - pt3;
    v2_2 = pt4 - pt3;
    d2 = Math.Min(Vector3d.CrossProduct(v1_1, v1_2).Length, Vector3d.CrossProduct(v2_1, v2_2).Length) / Math.Max(Vector3d.CrossProduct(v1_1, v1_2).Length, Vector3d.CrossProduct(v2_1, v2_2).Length);
    if (d1 > d2) test = true;
    else test = false;
    return test;
  }

  public bool isInside(double val, double A, double B)
  {
    bool retour;
    retour = false;
    if ((val >= Math.Min(A, B)) & (val <= Math.Max(A, B))) retour = true;
    return retour;
  }
# ---------- end c_script ----------
flip_matrix_2 = FlipMatrix(Data=shift_paths_2)
gradient = Gradient(
    LowerLimit=deconstruct_domain.Start,
    UpperLimit=deconstruct_domain.End,
    Parameter=cantilever_l_e_bending.trasl1,
    stops=[0.101: RGB(0, 76, 255), 0.204: RGB(54, 171, 255), 0.315: RGB(0, 192, 0), 0.499: RGB(0, 255, 72), 0.624: RGB(255, 251, 0), 0.779: RGB(245, 102, 0), 0.935: RGB(220, 0, 40)])
vector_display_ex_2 = VectorDisplayEx(Point=point, Vector=multiplication_3, Colour=ColourSwatch(SwatchColor=RGB(255, 0, 0)), Width=Slider(3, range=0..10))
brep_3 = Brep(flip_matrix)
brep_4 = Brep(flip_matrix_2)
gradient_2 = Gradient(
    LowerLimit=deconstruct_domain_2.Start,
    UpperLimit=deconstruct_domain_2.End,
    Parameter=[ghpython_script_2.a, cantilever_l_e_bending.sigmaz2],
    stops=[0.101: RGB(0, 76, 255), 0.204: RGB(54, 171, 255), 0.315: RGB(0, 192, 0), 0.499: RGB(0, 255, 72), 0.624: RGB(255, 251, 0), 0.779: RGB(245, 102, 0), 0.935: RGB(220, 0, 40)])
gradient_3 = Gradient(
    LowerLimit=deconstruct_domain_2.Start,
    UpperLimit=deconstruct_domain_2.End,
    Parameter=cantilever_l_e_bending.sigmaz2,
    stops=[0.101: RGB(0, 76, 255), 0.204: RGB(54, 171, 255), 0.315: RGB(0, 192, 0), 0.499: RGB(0, 255, 72), 0.624: RGB(255, 251, 0), 0.779: RGB(245, 102, 0), 0.935: RGB(220, 0, 40)])
mesh = Mesh(c_script.up_mesh)
custom_preview_lineweights = CustomPreviewLineweights(Shader=ColourSwatch(SwatchColor=RGBA(0, 0, 0, 213)), Thickness=Slider(1, range=0..100), Absolute=False)
custom_preview_lineweights_2 = CustomPreviewLineweights(Geometry=brep_3, Shader=gradient, Thickness=Slider(0.1, range=0..1), Absolute=Toggle(True))
mesh_colours = MeshColours(Mesh=geometry, Colours=gradient_2)
mesh_colours_2 = MeshColours(Mesh=ghpython_script_3.a, Colours=gradient_3)
custom_preview_lineweights_3 = CustomPreviewLineweights(
    Geometry=c_script.frontier,
    Shader=ColourSwatch(SwatchColor=RGB(0, 0, 0)),
    Thickness=Slider(0.1, range=0..1),
    Absolute=Toggle(True))
