# Grasshopper definition Nucleo_torsione.gh (Grasshopper 1.0.7)
# plug-ins: Human

number_slider = Slider(99, range=0..100)
division = Division(A=number_slider, B="2")
negative = Negative(Value=division)
vector_xyz = VectorXYZ(XComponent=negative, YComponent=0, ZComponent="0")  # -> Vector, Length
rectangle = Rectangle(Plane=PlaneXY(0, 0, 0), XSize=number_slider, YSize=Domain(-2, 2), Radius=0)  # -> Rectangle, Length
curve = Curve([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])
number_slider_2 = Slider(3.1, range=0..10)
number_slider_3 = Slider(5.779, range=0..10)
move = Move(Geometry=rectangle.Rectangle, Motion=vector_xyz.Vector)  # -> Geometry, Transform
numero_piani = Slider(10, range=0..100)
boundary_surfaces = BoundarySurfaces(Edges=curve)
h_interpiano = Panel("4")
surface = Surface(move.Geometry)
division_2 = Division(A=number_slider_2, B="2")
division_3 = Division(A=number_slider_3, B="2")
brep = Brep(surface)
vector_xyz_2 = VectorXYZ(XComponent=division_3, YComponent=division_2, ZComponent=0)  # -> Vector, Length
multiplication = Multiplication(A=numero_piani, B=h_interpiano)
plane_surface = PlaneSurface(Plane=PlaneXY(0, 0, 0), XSize=number_slider_3, YSize=number_slider_2)
vector_xyz_3 = VectorXYZ(XComponent=0, YComponent=0, ZComponent=0)  # -> Vector, Length
negative_2 = Negative(Value=vector_xyz_2.Vector)
line_sdl = LineSDL(Start=vector_xyz_3.Vector, Direction=Vector(0, 0, 1), Length=multiplication)
move_2 = Move(Geometry=plane_surface, Motion=negative_2)  # -> Geometry, Transform
length = Length(Curve=line_sdl)
division_4 = Division(A=length, B="350")
split_brep_multiple = SplitBrepMultiple(Brep=boundary_surfaces, Cutters=move_2.Geometry)
panel = Panel(division_4)
vector_xyz_4 = VectorXYZ(XComponent=0, YComponent=0, ZComponent=0)  # -> Vector, Length
list_item = ListItem(List=split_brep_multiple, Index=Slider(2, range=0..10), Wrap=True)
divide_length = DivideLength(Curve=line_sdl, Length=Slider(1, range=0..1))  # -> Points, Tangents, Parameters
surface_2 = Surface(list_item)
number_slider_4 = Slider(3, range=0..10)
vector_xyz_5 = VectorXYZ(XComponent="2", YComponent=0, ZComponent=0)  # -> Vector, Length
vector_xyz_6 = VectorXYZ(XComponent=Slider(10, range=0..100), YComponent="2", ZComponent=0)  # -> Vector, Length
multiplication_2 = Multiplication(A=vector_xyz_5.Vector, B=Slider(3, range=0..10))
negative_3 = Negative(Value=vector_xyz_6.Vector)
move_3 = Move(Geometry=divide_length.Points, Motion=negative_3)  # -> Geometry, Transform
vector_display_ex = VectorDisplayEx(
    Point=move_3.Geometry,
    Vector=multiplication_2,
    Colour=ColourSwatch(SwatchColor=RGBA(255, 0, 0, 213)),
    Width=Slider(1, range=0..1))
cantilever_l_e_bending = GhPythonScript(
    young_Modul="25000",
    shear_Modul="10800",
    torsion_costant="0.0020",
    sectorial_moment="654.3184656250002",
    Curve=line_sdl,
    section=brep,
    p1="19.8",
    ecc="2",
    scaleDef=Slider(193, range=0..1000))  # -> out, trasl1, rot, sectionDef, sectionBrep, Model, TotalVector, totalPoint; inputs Curve: Curve, section: Brep, scaleDef: Int32
# ---------- cantilever_l_e_bending: Python ----------
import Rhino.Geometry as rg
import ghpythonlib.components as ghcomp
import math as mt


## ASCISSA ##

def linspace(a, b, n=100):
    if n < 2:
        return b
    diff = (float(b) - a)/(n - 1)
    return [diff * i + a  for i in range(n)]

startPoint =  Curve.PointAtNormalizedLength(0.0)
parameterStart = Curve.ClosestPoint(startPoint, 0.01)[1]
planeStart = Curve.PerpendicularFrameAt(parameterStart)[1]

divideDistance = 1
DivCurve = ghcomp.DivideDistance(Curve,divideDistance)
PointsDivLength = DivCurve[0]

H = ghcomp.Length(Curve)
propSection = rg.AreaMassProperties.Compute( section)
I1 = propSection.CentroidCoordinatesMomentsOfInertia[0]
I2 = propSection.CentroidCoordinatesMomentsOfInertia[1]
I3 = propSection.CentroidCoordinatesMomentsOfInertia[2]


zi = linspace( 0, H, len( PointsDivLength ))
axis1 = planeStart[1]
axis2 = planeStart[2]
axis3 = planeStart[3]

E = young_Modul*1000
G = shear_Modul*1000
m = ecc*p1
k = torsion_costant
Iw = sectorial_moment
a = mt.sqrt(G*I3*k/(E*Iw))


trasl1 = []
transPoint = []
sectionDef = []
sectionBrep = []
rot = []
sectionModel = []
Model= []
TotalVector = []
totalPoint = []
for index, z in enumerate(zi):
    
    v1= p1*z**2*(6*H**2 - 4*H*z + z**2)/(24*E*I1)
    v1Vector = v1*axis1
    
    r2 = p1*z*(3*H**2 - 3*H*z + z**2)/(6*E*I1)
    
    w= -m*(-2*H*a*z + 2*H*mt.sinh(a*z) - 2*H*mt.cosh(a*z)/mt.tanh(H*a) + 2*H/mt.tanh(H*a) + a*z**2)/(2*E*Iw*a**3)
    rot.append(w*axis3)
    trasl1.append( v1Vector )
    MovDefpoint = ghcomp.Move(PointsDivLength[index], scaleDef*v1Vector)[0]
    transPoint.append( MovDefpoint )
    
    sectionPlane = ghcomp.Move(section, PointsDivLength[index])[0]
    sectionPlane2 = ghcomp.Move(sectionPlane, scaleDef*v1Vector)[0]
    centerRotatation = MovDefpoint
    #sectionPlane.Rotate( scaleDef*r1x, axis1, centerRotatation )
    sectionPlane2.Rotate( scaleDef*r2, axis2, centerRotatation )
    sectionPlane2.Rotate( scaleDef*w, axis3, centerRotatation )
    sectionDef.append( sectionPlane2 )
    sectionModel.append(sectionPlane)
    
    
    if index >=  1:
        # Modello deformato
        curveSection1 = ghcomp.DeconstructBrep( sectionDef[index-1] )[1]
        curveSection2 = ghcomp.DeconstructBrep( sectionDef[index] )[1]
        
        # Modello non deformato
        curveModel1 = ghcomp.DeconstructBrep( sectionModel[index - 1] )[1]
        curveModel2 = ghcomp.DeconstructBrep( sectionModel[index] )[1]
        
        no_pt = rg.Point3d.Unset
        norm_loft=rg.LoftType.Normal

        brep1 = []
        brepModel = []
        for i in range(0, len(curveSection1)):
            curve = [  curveSection1[i], curveSection2[i] ]
            breps = rg.Brep.CreateFromLoft(curve,no_pt,no_pt,norm_loft,False)
            brep1.append( breps )
        
            curveModel = [  curveModel1[i], curveModel2[i] ]
            breps = rg.Brep.CreateFromLoft(curveModel,no_pt,no_pt,norm_loft,False)
            brepModel.append( breps )
             
        sectionBrep.append(brep1)
        Model.append(brepModel)
        
        
    M2 = -p1*(H**2 - 2*H*z + z**2)/2
    ## TENSIONI ##
    curveModel1 = ghcomp.DeconstructBrep( sectionPlane )[1]
    PointCurve = ghcomp.DivideLength( curveModel1, 0.1 )[0]
    totalPoint.append( PointCurve )
    
    vector = []
    for value in PointCurve:
        sigma1 = M2/I1*value[0]
        sigma1Vector = rg.Vector3d( 0, 0, sigma1 )
        vector.append( sigma1Vector )
    TotalVector.append(vector)

#T2= p1*(-H + z)
# ---------- end cantilever_l_e_bending ----------
ghpython_script = GhPythonScript(x=cantilever_l_e_bending.totalPoint)  # -> out, a
# ---------- ghpython_script: Python ----------
a = x
# ---------- end ghpython_script ----------
ghpython_script_2 = GhPythonScript(x=cantilever_l_e_bending.TotalVector)  # -> out, a; same code as ghpython_script
list_to_tree = ListToTree(PythonList=cantilever_l_e_bending.sectionBrep)  # -> simplify(DataTree); inputs PythonList: list, BasePath: list of Int32
# ---------- list_to_tree: Python ----------
from Grasshopper import DataTree as Tree
from Grasshopper.Kernel.Data import GH_Path as Path
from System import Array

def list_to_tree(input, none_and_holes=False, base_path=[0]):
    """Transforms nestings of lists or tuples to a Grasshopper DataTree"""
    
    def process_one_item(input,tree,track):
        path = Path(Array[int](track))
        if len(input) == 0 and none_and_holes: tree.EnsurePath(path); return
        for i,item in enumerate(input):
            if hasattr(item, '__iter__'): #if list or tuple
                track.append(i); process_one_item(item,tree,track); track.pop()
            else:
                if none_and_holes: tree.Insert(item,path,i)
                elif item is not None: tree.Add(item,path)
    tree = Tree[object]()
    if input is not None: process_one_item(input,tree,base_path[:]); return tree
    

pythonList = PythonList or []
None_and_holes = False
Base_path = BasePath or [0]


DataTree = list_to_tree(pythonList,none_and_holes = None_and_holes, base_path= Base_path)
# ---------- end list_to_tree ----------
list_to_tree_2 = ListToTree(PythonList=cantilever_l_e_bending.TotalVector)  # -> simplify(DataTree); inputs PythonList: list, BasePath: list of Int32; same code as list_to_tree
list_to_tree_3 = ListToTree(PythonList=cantilever_l_e_bending.Model)  # -> simplify(DataTree); inputs PythonList: list, BasePath: list of Int32; same code as list_to_tree
ghpython_script_3 = GhPythonScript(x=ghpython_script.a)  # -> out, simplify(a); inputs x: list; same code as ghpython_script
ghpython_script_4 = GhPythonScript(x=ghpython_script_2.a)  # -> out, simplify(a); inputs x: list; same code as ghpython_script
multiplication_3 = Multiplication(A=ghpython_script_4.a, B=Slider(0.001, range=0..0.01))
galapagos = Galapagos(fitness=deconstruct_domain, gene=number_slider)
point = Point(ghpython_script_3.a)
shift_paths = ShiftPaths(Data=list_to_tree, Offset=-1)
bounds = Bounds(Numbers=flatten(cantilever_l_e_bending.trasl1))
shift_paths_2 = ShiftPaths(Data=list_to_tree_3, Offset=-1)
vector_display_ex_2 = VectorDisplayEx(Point=point, Vector=multiplication_3, Colour=ColourSwatch(SwatchColor=RGB(255, 0, 0)), Width=2)
flip_matrix = FlipMatrix(Data=shift_paths)
flip_matrix_2 = FlipMatrix(Data=shift_paths_2)
deconstruct_domain = DeconstructDomain(Domain=bounds)  # -> Start, End
brep_2 = Brep(flip_matrix)
bounds_2 = Bounds(Numbers=flatten(cantilever_l_e_bending.rot))
brep_3 = Brep(flip_matrix_2)
bounds_3 = Bounds(Numbers=flatten(cantilever_l_e_bending.trasl1))
deconstruct_domain_2 = DeconstructDomain(Domain=bounds_3)  # -> Start, End
custom_preview_lineweights = CustomPreviewLineweights(
    Geometry=brep_3,
    Shader=ColourSwatch(SwatchColor=RGBA(110, 110, 110, 213)),
    Thickness=Slider(0, range=0..1),
    Absolute=False)
gradient = Gradient(
    LowerLimit=deconstruct_domain_2.Start,
    UpperLimit=deconstruct_domain_2.End,
    Parameter=cantilever_l_e_bending.trasl1,
    stops=[0.101: RGB(0, 76, 255), 0.204: RGB(54, 171, 255), 0.315: RGB(0, 192, 0), 0.499: RGB(0, 255, 72), 0.624: RGB(255, 251, 0), 0.779: RGB(245, 102, 0), 0.935: RGB(220, 0, 40)])
custom_preview_lineweights_2 = CustomPreviewLineweights(Geometry=brep_2, Shader=gradient, Thickness=Slider(0.1, range=0..1), Absolute=Toggle(True))
