# Grasshopper definition piastra con carico distribuito.gh (Grasshopper 1.0.7)
# plug-ins: Human

number_slider = Slider(10, range=0..1000)
multiplication = Multiplication(A=Slider(5, range=0..100), B=number_slider)
division = Division(A="1", B=multiplication)
number_slider_2 = Slider(100, range=0..100)
number_slider_3 = Slider(100, range=0..100)
number_slider_4 = Slider(30, range=0..100)
division_2 = Division(A=number_slider, B=number_slider_4)
ghpython_script = GhPythonScript(
    lx=number_slider,
    ly=number_slider,
    E="25000",
    ni="0.1",
    t="30",
    q="10",
    n=Slider(1, range=0..10),
    m=Slider(1, range=0..10),
    scale=multiplication,
    dx=number_slider_4,
    dy=Slider(30, range=0..100))  # -> out, model, wzValueVertix, joinedMesh; inputs n: Int32, m: Int32, dx: Int32, dy: Int32
# ---------- ghpython_script: Python ----------
import Rhino.Geometry as rg
import math as mt

## ASCISSA ##

def linspace(a, b, n=100):
    if n < 2:
        return b
    diff = (float(b) - a)/(n - 1)
    return [diff * i + a  for i in range(n)]


def gradientJet(value, valueMax, valueMin):
    listcolo = [[0, 0, 102 ],
                [0, 0, 255],
                [0, 64, 255],
                [0, 128, 255],
                [0, 191, 255],
                [0, 255, 255],
                [0, 255, 191],
                [0, 255, 128],
                [0, 255, 64],
                [0, 255, 0],
                [64, 255, 0],
                [128, 255, 0],
                [191, 255, 0],
                [255, 255, 0],
                [255, 191, 0],
                [255, 128, 0],
                [255, 64, 0],
                [255, 0, 0],
                [230, 0, 0],
                [204, 0, 0]]
    domain = linspace( valueMin,  valueMax, len( listcolo ) )
    for i in range(1,len(domain)):
        if  domain[i-1] <= value <= domain[i]:
            return listcolo[len(listcolo)-i]


x = linspace(0, lx, dx)
y = linspace(0, ly,dy)

t = t/1000
E = E*1000

D = E*t/(12*(1-ni**2))

#m,n =2,2


w = []
point = []
for yi in y:
    wValue = []
    wPoint = []
    for xi in x :
        wx = -16*lx**4*q/(D*mt.pi**4)*(mt.sin(m*mt.pi*xi/lx)*mt.sin(m*mt.pi*yi/ly))/(m*n*(m**2+(lx/ly*n)**2)**2)
        wValue.append(wx)
        wPoint.append(rg.Point3d(xi, yi, scale*wx ))
    point.append( wPoint)
    w.append(wValue)

Mesh = []
meshModel = []
wzValueVertix = []
valueMax = max(max(w))
valueMin = min(min(w))
div = (valueMax + mt.fabs(valueMin))/20
Domain = linspace(valueMin, valueMax, 20)

curve1 = []
curve2 = []
curve3 = []
curve4 = []
curve5 = []

for i in range(0,len(w)-1):
    mesh1 = []
    dispZ = []
    meshView = []
    for j in range(0, len(w[0])-1):
        vertix1 = point[i][j]
        vertix2 = point[i+1][j]
        vertix3 = point[i+1][j+1]
        vertix4 = point[i][j+1]
        
        wzVertix = [ w[i][j], w[i+1][j], w[i+1][j+1], w[i][j+1] ]
        dispZ.append( wzVertix )
       
        
        mesh = rg.Mesh()
        mesh.Vertices.Add( vertix1 ) 
        mesh.Vertices.Add( vertix2 ) 
        mesh.Vertices.Add( vertix3 ) 
        mesh.Vertices.Add( vertix4 )
        
        color = gradientJet( w[i][j], valueMax, valueMin )
        mesh.VertexColors.Add(color[0],color[1],color[2]);
        
        color = gradientJet( w[i+1][j], valueMax, valueMin )
        mesh.VertexColors.Add(color[0],color[1],color[2]);

        color = gradientJet( w[i+1][j+1], valueMax, valueMin )
        mesh.VertexColors.Add(color[0],color[1],color[2]);
        
        color = gradientJet( w[i][j+1], valueMax, valueMin )
        mesh.VertexColors.Add(color[0],color[1],color[2]);
        
        mesh.Faces.AddFace(0, 1, 2, 3)
        mesh1.append( mesh )
        
        ## Modello non deformato ##
        
        vertix1 = rg.Point3d( vertix1[0], vertix1[1], 0)
        vertix2 = rg.Point3d( vertix2[0], vertix2[1], 0)
        vertix3 = rg.Point3d( vertix3[0], vertix3[1], 0)
        vertix4 = rg.Point3d( vertix4[0], vertix4[1], 0)
        
        mesh2 = rg.Mesh()
        mesh2.Vertices.Add( vertix1 ) 
        mesh2.Vertices.Add( vertix2 ) 
        mesh2.Vertices.Add( vertix3 ) 
        mesh2.Vertices.Add( vertix4 )

        mesh2.Faces.AddFace(0, 1, 2, 3)
        meshView.append( mesh2 )
        
        
    meshModel.append( meshView )
    Mesh.append( mesh1 )
    wzValueVertix.append( dispZ)

joinedMesh = rg.Mesh()
for mesh in Mesh:
    joinedMesh.Append(mesh)

model = rg.Mesh()
for mesh2 in meshModel:
    model.Append(mesh2)
# ---------- end ghpython_script ----------
multiplication_2 = Multiplication(A=division_2, B=Slider(28, range=0..100))
geometry = Geometry(ghpython_script.model)
deconstruct_mesh = DeconstructMesh(Mesh=geometry)  # -> Vertices, Faces, Colours, Normals
ghpython_script_2 = GhPythonScript(x=ghpython_script.joinedMesh)  # -> out, simplify(a)
# ---------- ghpython_script_2: Python ----------
a = x
# ---------- end ghpython_script_2 ----------
ghpython_script_3 = GhPythonScript()  # -> out, simplify(a); same code as ghpython_script_2
ghpython_script_4 = GhPythonScript(x=ghpython_script.wzValueVertix)  # -> out, simplify(a); same code as ghpython_script_2
ghpython_script_5 = GhPythonScript(point=deconstruct_mesh.Vertices, xCoord=multiplication_2)  # -> out, Index, Point; inputs point: list of Point3d
# ---------- ghpython_script_5: Python ----------
import Rhino.Geometry as rg
import math as mt

Index = []
Point = []
for index, value in enumerate(point):
    if xCoord - 0.1 <= value[0] <= xCoord + 0.1 :
        Index.append( index )
        Point.append( value )
# ---------- end ghpython_script_5 ----------
geometry_2 = Geometry(ghpython_script_3.a)
geometry_3 = Geometry(ghpython_script_2.a)
ghpython_script_6 = GhPythonScript(x=ghpython_script_4.a)  # -> out, simplify(a); same code as ghpython_script_2
panel = Panel(ghpython_script_6.a)
point = Point(ghpython_script_5.Point)
number = Number(ghpython_script_6.a)
list_item = ListItem(List=flatten(number), Index=ghpython_script_5.Index, Wrap=True)
multiplication_3 = Multiplication(A=list_item, B=Slider(56, range=0..100))
unit_z = UnitZ(Factor=multiplication_3)
bounds = Bounds(Numbers=flatten(ghpython_script_6.a))
triangulate = Triangulate(Mesh=geometry_3)  # -> Mesh, Count
range = Range(Domain=bounds, Steps=Slider(10, range=0..20))
c_script = CSharpScript(mesh=triangulate.Mesh, values=flatten(number), iso=range)  # -> out, low_mesh, up_mesh, simplify(low_values), up_values, simplify(frontier); inputs mesh: Mesh, values: list of Double, iso: Double
# ---------- c_script: C# ----------
    //This script cut a mesh using an iso-value. Values are put on each vertex of the mesh
    //Developped by Laurent Delrieu
    //1st of September 2015

    Mesh mesh_low = new Mesh();
    Mesh mesh_up = new Mesh();
    List<double> lv = new List<Double>();
    List<double> uv = new List<Double>();
    List<Line> lines = new List<Line>();

    double min;
    double max;
    int A, B, C;

    //For each face
    for(int i = 0;i < _mesh.Faces.Count;i++)
    {
      //It is implied that Mesh has just triangles
      //Here it is looked if iso value in on face
      A = _mesh.Faces[i].A;
      B = _mesh.Faces[i].B;
      C = _mesh.Faces[i].C;
      min = Math.Min(Math.Min(_values[A], _values[B]), _values[C]);
      max = Math.Max(Math.Max(_values[A], _values[B]), _values[C]);

      //If OK there will be a triangulation
      if (isInside(_iso, min, max))
      {
        if (isInside(_iso, _values[A], _values[B]))
        {
          if (isInside(_iso, _values[A], _values[C])) remesh(_mesh, i, _values, _iso, B, A, C, ref mesh_low, ref mesh_up, ref lv, ref uv, ref lines);
          else remesh(_mesh, i, _values, _iso, A, B, C, ref mesh_low, ref mesh_up, ref lv, ref uv, ref lines);
        }
        else    remesh(_mesh, i, _values, _iso, A, C, B, ref mesh_low, ref mesh_up, ref lv, ref uv, ref lines);
      }
      else   add_face(_mesh, i, _values, _iso, A, C, B, ref mesh_low, ref mesh_up, ref lv, ref uv);
    }//End for

    mesh_low.Weld(0.001);
    mesh_low.Normals.ComputeNormals();
    mesh_low.Compact();
    mesh_up.Weld(0.001);
    mesh_up.Normals.ComputeNormals();
    mesh_up.Compact();

    low_mesh = mesh_low;
    up_mesh = mesh_up;
    low_values = lv;
    up_values = uv;

    // Rhino.Geometry.Curve.JoinCurves
    frontier = lines;
# ---------- c_script: C# additional code ----------
  public void remesh(Mesh M, int i, List<double> V, double iso, int A, int B, int C, ref Mesh mesh_low, ref Mesh mesh_up, ref List<double> lv, ref List<double> uv, ref List<Line> lines)
  {
    //M is an input mesh (triangular)
    //V are values on vertex
    //Iso is a value for splitting
    //A B C are indices for splitting segment AB and BC, so if value on B is lower than
    Point3f pAB = new Point3f();
    Point3f pBC = new Point3f();
    int npt;

    pAB = M.Vertices[A] + Vector3f.Multiply((float) ((iso - V[A]) / (V[B] - V[A])), Point3f.Subtract(M.Vertices[B], M.Vertices[A]));
    pBC = M.Vertices[B] + Vector3f.Multiply((float) ((iso - V[B]) / (V[C] - V[B])), Point3f.Subtract(M.Vertices[C], M.Vertices[B]));

    lines.Add(new Line(pAB, pBC));

    if (V[B] <= iso)
    {
      npt = mesh_low.Vertices.Count;
      mesh_low.Vertices.Add(M.Vertices[B]); //npt
      mesh_low.Vertices.Add(pAB); //npt+1
      mesh_low.Vertices.Add(pBC); //npt+2
      mesh_low.Faces.AddFace(npt, npt + 1, npt + 2);
      lv.Add(V[B]);
      lv.Add(iso);
      lv.Add(iso);

      npt = mesh_up.Vertices.Count;
      mesh_up.Vertices.Add(M.Vertices[A]); //npt
      mesh_up.Vertices.Add(pAB); //npt+1
      mesh_up.Vertices.Add(pBC); //npt+2
      mesh_up.Vertices.Add(M.Vertices[C]); //npt+3
      //Meshing of a quandrangle in the best 2 triangles
      if (isBest(M.Vertices[A], pAB, pBC, M.Vertices[C]))
      {
        mesh_up.Faces.AddFace(npt, npt + 1, npt + 2);
        mesh_up.Faces.AddFace(npt + 2, npt + 3, npt);
      }
      else
      {
        mesh_up.Faces.AddFace(npt, npt + 1, npt + 3);
        mesh_up.Faces.AddFace(npt + 1, npt + 2, npt + 3);
      }

      uv.Add(V[A]);
      uv.Add(iso);
      uv.Add(iso);
      uv.Add(V[C]);
    }
    else
    {
      npt = mesh_up.Vertices.Count;
      mesh_up.Vertices.Add(M.Vertices[B]); //npt
      mesh_up.Vertices.Add(pAB); //npt+1
      mesh_up.Vertices.Add(pBC); //npt2
      mesh_up.Faces.AddFace(npt, npt + 1, npt + 2);
      uv.Add(V[B]);
      uv.Add(iso);
      uv.Add(iso);

      npt = mesh_low.Vertices.Count;
      mesh_low.Vertices.Add(M.Vertices[A]); //npt
      mesh_low.Vertices.Add(pAB); //npt+1
      mesh_low.Vertices.Add(pBC); //npt+2
      mesh_low.Vertices.Add(M.Vertices[C]); //npt+3
      if (isBest(M.Vertices[A], pAB, pBC, M.Vertices[C]))
      {
        mesh_low.Faces.AddFace(npt, npt + 1, npt + 2);
        mesh_low.Faces.AddFace(npt + 2, npt + 3, npt);
      }
      else
      {
        mesh_low.Faces.AddFace(npt, npt + 1, npt + 3);
        mesh_low.Faces.AddFace(npt + 1, npt + 2, npt + 3);
      }
      lv.Add(V[A]);
      lv.Add(iso);
      lv.Add(iso);
      lv.Add(V[C]);
    }
  }
  public void add_face(Mesh M, int i, List<double> V, double iso, int A, int B, int C, ref Mesh mesh_low, ref Mesh mesh_up, ref List<double> lv, ref List<double> uv)
  {
    //Value is lower of bigger than ISO

    //M is an input mesh (triangular)
    //V are values on vertex
    //Iso is a value for splitting
    int npt;

    if (V[B] <= iso)
    {
      npt = mesh_low.Vertices.Count;
      mesh_low.Vertices.Add(M.Vertices[A]); //npt
      mesh_low.Vertices.Add(M.Vertices[B]); //npt+1
      mesh_low.Vertices.Add(M.Vertices[C]); //npt+2
      mesh_low.Faces.AddFace(npt, npt + 1, npt + 2);
      lv.Add(V[A]);
      lv.Add(V[B]);
      lv.Add(V[C]);
    }
    else
    {
      npt = mesh_up.Vertices.Count;
      mesh_up.Vertices.Add(M.Vertices[A]); //npt
      mesh_up.Vertices.Add(M.Vertices[B]); //npt+1
      mesh_up.Vertices.Add(M.Vertices[C]); //npt+2
      mesh_up.Faces.AddFace(npt, npt + 1, npt + 2);
      uv.Add(V[A]);
      uv.Add(V[B]);
      uv.Add(V[C]);
    }
  }
  //For a quandrangle done with 4 points the script look at the best solution. So ration of surface between the 2 traingles must be the bigger
  public bool isBest(Point3f pt1, Point3f pt2, Point3f pt3, Point3f pt4)
  {
    bool test = true;
    double d1, d2;
    Vector3d v1_1 = new Vector3d();
    Vector3d v1_2 = new Vector3d();
    Vector3d v2_1 = new Vector3d();
    Vector3d v2_2 = new Vector3d();

    v1_1 = pt2 - pt1;
    v1_2 = pt3 - pt1;
    v2_1 = pt3 - pt1;
    v2_2 = pt4 - pt1;
    d1 = Math.Min(Vector3d.CrossProduct(v1_1, v1_2).Length, Vector3d.CrossProduct(v2_1, v2_2).Length) / Math.Max(Vector3d.CrossProduct(v1_1, v1_2).Length, Vector3d.CrossProduct(v2_1, v2_2).Length);

    v1_1 = pt2 - pt1;
    v1_2 = pt4 - pt1;
    v2_1 = pt2 - pt3;
    v2_2 = pt4 - pt3;
    d2 = Math.Min(Vector3d.CrossProduct(v1_1, v1_2).Length, Vector3d.CrossProduct(v2_1, v2_2).Length) / Math.Max(Vector3d.CrossProduct(v1_1, v1_2).Length, Vector3d.CrossProduct(v2_1, v2_2).Length);
    if (d1 > d2) test = true;
    else test = false;
    return test;
  }

  public bool isInside(double val, double A, double B)
  {
    bool retour;
    retour = false;
    if ((val >= Math.Min(A, B)) & (val <= Math.Max(A, B))) retour = true;
    return retour;
  }
# ---------- end c_script ----------
deconstruct_domain = DeconstructDomain(Domain=bounds)  # -> Start, End
move = Move(Geometry=point, Motion=unit_z)  # -> Geometry, Transform
number_slider_5 = Slider(1, range=0..1)
mesh = Mesh(c_script.up_mesh)
interpolate = Interpolate(Vertices=move.Geometry, Degree=number_slider_5, Periodic=False, KnotStyle=1)  # -> Curve, Length, Domain
interpolate_2 = Interpolate(Vertices=point, Degree=number_slider_5, Periodic=False, KnotStyle=1)  # -> Curve, Length, Domain
gradient = Gradient(
    LowerLimit=deconstruct_domain.End,
    UpperLimit=deconstruct_domain.Start,
    Parameter=ghpython_script_6.a,
    stops=[0.101: RGB(0, 76, 255), 0.204: RGB(54, 171, 255), 0.315: RGB(0, 192, 0), 0.499: RGB(0, 255, 72), 0.624: RGB(255, 251, 0), 0.779: RGB(245, 102, 0), 0.935: RGB(220, 0, 40)])
ruled_surface = RuledSurface(CurveA=interpolate_2.Curve, CurveB=interpolate.Curve)
mesh_colours = MeshColours(Mesh=geometry_3, Colours=flatten(gradient))
custom_preview_lineweights = CustomPreviewLineweights(
    Geometry=c_script.frontier,
    Shader=ColourSwatch(SwatchColor=RGB(0, 0, 0)),
    Thickness=Slider(0, range=0..1),
    Absolute=Toggle(True))
custom_preview_lineweights_2 = CustomPreviewLineweights(
    Geometry=ruled_surface,
    Shader=ColourSwatch(SwatchColor=RGB(13, 145, 217)),
    Thickness=Slider(0, range=0..1),
    Absolute=Toggle(True))
